# Grasshopper definition 01_TUFTING_IMAGEN.gh (Grasshopper 1.0.8)
# plug-ins: treesloth01, Pufferfish, Human, PTComponentLibrary, VectorizeGh, NGon_RH8, Flexibility

Y = UnitY(Factor=1)
X = UnitX(Factor=1)
Y_2 = UnitY(Factor=1)
X_2 = UnitX(Factor=1)

# ----
# Distancia entre
# líneas de tejido
number_slider = Slider(5, range=1..20)

# ----
# Distancia entre
# líneas de tejido
number_slider_2 = Slider(5, range=1..20)

panel = Panel("""0
1""")
number_slider_3 = Slider(1, range=1..5)
neg = Negative(Value=number_slider_3)
number_slider_4 = Slider(1, range=1..5)
neg_2 = Negative(Value=number_slider_4)
panel_2 = Panel("""0
-1""")
panel_3 = Panel("""0
1""")
panel_4 = Panel("""-1
-2""")
number_slider_5 = Slider(-10, range=-15..-1)
number_slider_6 = Slider(-10, range=-15..-1)

# ----
# COLORES CUSTOM
# ELEGIR COLOR
# PARA CADA ZONA
swatch = ColourSwatch(SwatchColor=RGB(255, 0, 0))

# ----
# IMAGEN
merge = Merge(
    Data1=swatch,
    Data2=ColourSwatch(SwatchColor=RGB(111, 196, 79)),
    Data3=ColourSwatch(SwatchColor=RGB(0, 0, 174)),
    Data4=ColourSwatch(SwatchColor=RGB(251, 224, 0)),
    Data5=ColourSwatch(SwatchColor=RGB(94, 68, 19)),
    Data6=ColourSwatch(SwatchColor=RGB(102, 48, 86)),
    Data7=ColourSwatch(SwatchColor=RGB(127, 157, 227)))

text_label_size = Panel("15")
swatch_2 = ColourSwatch(SwatchColor=RGB(0, 0, 0))

# ----
# INTERNALIZE PARA ARCHIVO
# 03_TUFTING_KUKA_GEOMETRY
crv = Curve(Tree({0}: [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], {1}: [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], {2}: [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], {3}: [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], {4}: [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], {5}: [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], {6}: [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]))

sonrisas = Curve(Tree({0}: [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], {1}: [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], {2}: [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], {3}: [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], {4}: [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], {5}: [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], {6}: [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], {7}: [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]))
curvas_horizontales_iguales = Curve(Tree({0}: [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], {1}: [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], {2}: [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], {3}: [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], {4}: [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], {5}: [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]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))

# ----
# PROCESADO PREVIO
#      DE LA IMAGEN
# RUTA Y VISUALIZACION
# IMAGEN EN JPG
path = FilePath("G:\Mi unidad\ROBOT\Apps Robot  GH\1200 Tufting\Pruebas_Lorena\imagenes prueba\54167563-0fe4-4dee-84cc-0191ad56c7e2.jpg")

# ----
# VECTORIZACION IMAGEN
# Afinar con sliders
number_slider_7 = Slider(0.199, range=0..1)
vectorize = Vectorize(
    Path=path,
    Threshold=number_slider_7,
    Speckles=Slider(100, range=0..100),
    Corners=Slider(1.34, range=0..1.34),
    Tolerance=Slider(0.17, range=0..1),
    Border=Toggle(True))

len = Length(Curve=vectorize)
sort = SortList(Keys=len, ValuesA=vectorize)  # -> Keys, reverse(ValuesA)

# ----
# BOUNDARIES
panel_5 = Panel("""0
1""")
cull_i = CullIndex(List=sort.ValuesA, Indices=panel_5, Wrap=True)

# ----
# CONTORNO
contorno = ListItem(List=sort.ValuesA, Index=Slider(0, range=0..5), Wrap=True)

area = Area(Geometry=cull_i)  # -> Area, Centroid
# FASE 1_GENERACION DE LINEAS_TOOLPATH
alongcrv = SortAlongCurve(Points=area.Centroid, Curve=contorno)  # -> Points, Indices
item = ListItem(List=cull_i, Index=alongcrv.Indices, Wrap=True)
# FASE 2_DETECCION Y ELECCION DE COLORES
edgesdir = EdgesFromDirections(Brep=contorno, Directions=X_2, Reflex=True, Angle=0)  # -> Edges, Indices, Map
edgesdir_2 = EdgesFromDirections(Brep=contorno, Directions=Y_2, Reflex=True, Angle=0)  # -> Edges, Indices, Map
len_2 = Length(Curve=edgesdir.Edges)
len_3 = Length(Curve=edgesdir_2.Edges)
drec = DeconstuctRectangle(Rectangle=contorno)  # -> BasePlane, XInterval, YInterval
avr = Average(Input=len_2)
avr_2 = Average(Input=len_3)
num = Number(drec.XInterval)
num_2 = Number(drec.YInterval)
division = Division(A=avr_2, B=avr)

multiplication = Multiplication(A=avr, B=division)
rectangle = Rectangle(Plane=PlaneXY(0, 0, 0), XSize=avr, YSize=multiplication, Radius=0)  # -> Rectangle, Length
panel_6 = Panel(multiplication)
img = ImportImage(File=path, Rectangle=rectangle.Rectangle, XSamples=avr, YSamples=multiplication)

# ----
# Medias a indicar en
# Image Sampler
panel_7 = Panel(avr)

# ----
# Medias a indicar en
# Image Sampler
panel_8 = Panel(avr_2)

division_2 = Division(A=num_2, B=number_slider)
division_3 = Division(A=num, B=number_slider)
round = Round(Number=division_3)  # -> Nearest, Floor, Ceiling
round_2 = Round(Number=division_2)  # -> Nearest, Floor, Ceiling
debrep = DeconstructBrep(Brep=contorno)  # -> Faces, Edges, Vertices
dom = ConstructDomain(DomainStart=0, DomainEnd=avr)
item_2 = ListItem(List=debrep.Vertices, Index=0, Wrap=True)
rectangle_2 = Rectangle(Plane=PlaneXY(0, 0, 0), XSize=avr, YSize=avr, Radius=0)  # -> Rectangle, Length
range = Range(Domain=dom, Steps=round.Nearest)
ptplanar = PlanarGrid(
    BasePoint=item_2,
    IDir=Vector(1, 0, 0),
    JDir=Vector(0, 1, 0),
    IDistance=number_slider,
    JDistance=number_slider,
    INumber=round.Nearest,
    JNumber=round_2.Nearest)  # -> flatten(Grid)
pt = ConstructPoint(XCoordinate=graft(range), YCoordinate=range, ZCoordinate=0)  # -> flatten(Point)
mesh_uv = MeshSurface(Surface=rectangle_2.Rectangle, UCount=round.Nearest, VCount=round.Nearest, Overhang=True, Equalize=False)
crv_2 = Curve(simplify(graft(cull_i)))
demesh = DeconstructMesh(Mesh=mesh_uv)  # -> Vertices, Faces, Colours, Normals
image = ImageSampler(
    pt,
    FilePath="G:\Mi unidad\ROBOT\Apps Robot  GH\1200 Tufting\Pruebas_Lorena\imagenes prueba\54167563-0fe4-4dee-84cc-0191ad56c7e2.jpg",
    Filter="Colour",
    Interpolate=False,
    Umax=778.544061,
    Umin=1,
    Vmax=778.544061,
    Vmin=1,
    Wrap=1)
boundary = BoundarySurfaces(Edges=crv_2)

# ----
# Áreas detectadas y orden
number_slider_8 = Slider(6, range=0..6)
l_branch = ListBranch(T=crv_2, i=number_slider_8)

offsrf = OffsetSurface(Surface=boundary, Distance=number_slider_3, BothSides=neg, CreateSolid=True)
conmesh = ConstructMesh(Vertices=demesh.Vertices, Faces=demesh.Faces, Colours=image)
brepinc = PointInBrep(Brep=simplify(offsrf), Point=ptplanar, Strict=False)
mesh = Mesh(conmesh)
dispatch = Dispatch(List=ptplanar, DispatchPattern=brepinc)  # -> ListA, ListB
demesh_2 = DeconstructMesh(Mesh=mesh)  # -> Vertices, Faces, Colours, Normals
flatten = FlattenTree(Tree=boundary, Path="{0}")
offsrf_2 = OffsetSurface(Surface=flatten, Distance=number_slider_4, BothSides=neg_2, CreateSolid=True)

# ----
# ORDENAR DIRECCIONES DE TEJIDO
# angle tolerance (degrees)
# Test vector
sort_pt = SortPoints(Points=simplify(dispatch.ListA))  # -> Points, Indices
pline = PolyLine(Vertices=sort_pt.Points, Closed=invert(False))
explode = Explode(Curve=pline, Recursive=True)  # -> Segments, Vertices
crv_3 = Curve(explode.Segments)
vec = VectorXYZ(XComponent=Slider(0, range=0..1), YComponent=Slider(1, range=0..1), ZComponent=Slider(0, range=0..1))  # -> Vector, Length
unit = UnitVector(Vector=crv_3)
xy = XYPlane(Origin=Point(0, 0, 0))
angle = Angle(VectorA=vec.Vector, VectorB=unit, Plane=xy)  # -> simplify(Angle), Reflex
deg = Degrees(Radians=angle.Angle)
smaller = SmallerThan(FirstNumber=deg, SecondNumber=Slider(1, range=1..90))  # -> SmallerThan, OrEqualTo
cull = CullPattern(List=crv_3, CullPattern=smaller.SmallerThan)  # -> simplify(List)
clean = CleanTree(RemoveNulls=True, RemoveInvalid=True, RemoveEmpty=invert(False), Tree=cull)  # -> simplify(Tree)
renumber = RenumberPaths(Data=clean)
join = JoinCurves(Curves=renumber, Preserve=False)  # -> simplify(Curves)
midpt = CurveMiddle(Curve=join)
pdecon = Deconstruct(Point=midpt)  # -> XComponent, YComponent, ZComponent
sort_2 = SortList(Keys=pdecon.XComponent, ValuesA=join)  # -> Keys, ValuesA

cp = ClosestPoint(Point=sort_pt.Points, Cloud=demesh_2.Vertices)  # -> ClosestPoint, simplify(CPIndex), Distance
item_3 = ListItem(List=demesh_2.Colours, Index=cp.CPIndex, Wrap=True)  # -> simplify(Item)
avr_3 = Average(Input=item_3)
msplit = MeshSplit(Mesh=mesh, Splitters=offsrf_2)  # -> simplify(Result)
item_4 = ListItem(List=msplit, Index=Slider(1, range=0..1), Wrap=True)

# ---- group: Legend
# LEYENDA
bbox = BoundingBox(Content=mesh, Plane=PlaneXY(0, 0, 0))  # -> Box, Box_2
# COLORES REALES
boxprop = BoxProperties(Box=bbox.Box)  # -> Center, Diagonal, Area, Volume, Degeneracy
lng = ListLength(List=flatten(avr_3))
pdecon_2 = Deconstruct(Point=boxprop.Diagonal)  # -> XComponent, YComponent, ZComponent
division_4 = Division(A=pdecon_2.YComponent, B=lng)
legend_shift = Panel("200")
rectangle_3 = Rectangle(Plane=PlaneXY(0, 0, 0), XSize="100", YSize=division_4, Radius=0)  # -> Rectangle, Length
series = Series(Start=0, Step=division_4, Count=lng)
Y_3 = UnitY(Factor=series)
X_3 = UnitX(Factor=legend_shift)
subtraction = Subtraction(A=Y_3, B=X_3)
move = Move(Geometry=rectangle_3.Rectangle, Motion=subtraction)  # -> Geometry, Transform
area_2 = Area(Geometry=move.Geometry)  # -> Area, simplify(graft(Centroid))
srf = Surface(move.Geometry)

# LEYENDA
bbox_2 = BoundingBox(Content=mesh, Plane=PlaneXY(0, 0, 0))  # -> Box, Box_2
boxprop_2 = BoxProperties(Box=bbox_2.Box)  # -> Center, Diagonal, Area, Volume, Degeneracy
lng_2 = ListLength(List=flatten(avr_3))
pdecon_3 = Deconstruct(Point=boxprop_2.Diagonal)  # -> XComponent, YComponent, ZComponent
division_5 = Division(A=pdecon_3.YComponent, B=lng_2)
legend_shift_2 = Panel("200")
rectangle_4 = Rectangle(Plane=PlaneXY(0, 0, 0), XSize="100", YSize=division_5, Radius=0)  # -> Rectangle, Length
series_2 = Series(Start=0, Step=division_5, Count=lng_2)
Y_4 = UnitY(Factor=series_2)
X_4 = UnitX(Factor=legend_shift_2)
subtraction_2 = Subtraction(A=Y_4, B=X_4)
move_2 = Move(Geometry=rectangle_4.Rectangle, Motion=subtraction_2)  # -> Geometry, Transform
area_3 = Area(Geometry=move_2.Geometry)  # -> Area, graft(Centroid)
srf_2 = Surface(move_2.Geometry)

# ----
lng_3 = ListLength(List=flatten(avr_3))

# ----
# IMAGEN
area_4 = Area(Geometry=item_4)  # -> Area, graft(Centroid)

series_3 = Series(Start=1, Step=1, Count=lng_3)  # -> simplify(graft(Series))

preview = CustomPreview(Geometry=simplify(graft(item_4)), Material=avr_3)
justified_text = JustifiedText3d(
    Location=area_4.Centroid,
    Text=series_3,
    Size=text_label_size,
    Color=swatch_2,
    HorizontalAlignment=1,
    VerticalAlginment=1,
    UseMeshes=False,
    Bake=False)

# ---- group: Legend
preview_2 = CustomPreview(Geometry=simplify(graft(srf)), Material=avr_3)
justified_text_2 = JustifiedText3d(
    Location=area_2.Centroid,
    Text=series_3,
    Size=text_label_size,
    Color=swatch_2,
    HorizontalAlignment=1,
    VerticalAlginment=1,
    UseMeshes=False,
    Bake=False)

# ----
# ELIMINAR LONGITUDES PEQUEÑAS
eliminar_longitudes = Panel("20")
len_4 = Length(Curve=sort_2.ValuesA)
larger = LargerThan(FirstNumber=len_4, SecondNumber=eliminar_longitudes)  # -> LargerThan, OrEqualTo
cull_2 = CullPattern(List=sort_2.ValuesA, CullPattern=larger.LargerThan)

preview_3 = CustomPreview(Geometry=graft(flatten), Material=simplify(graft(merge)))
justified_text_3 = JustifiedText3d(
    Location=area_4.Centroid,
    Text=series_3,
    Size=text_label_size,
    Color=swatch_2,
    HorizontalAlignment=1,
    VerticalAlginment=1,
    UseMeshes=False,
    Bake=False)

# ---- group: Legend
preview_4 = CustomPreview(Geometry=graft(srf_2), Material=graft(merge))
justified_text_4 = JustifiedText3d(
    Location=area_3.Centroid,
    Text=series_3,
    Size=text_label_size,
    Color=swatch_2,
    HorizontalAlignment=1,
    VerticalAlginment=1,
    UseMeshes=False,
    Bake=False)

# ----
crv_4 = Curve(cull_2)

# ----
# COMPROBACION VISUAL ORDEN
number_slider_9 = Slider(0, range=0..6)
l_branch_2 = ListBranch(T=crv_4, i=number_slider_9)
curvepoint = PointOnCurve(l_branch_2, parameter=0)
item_5 = ListItem(List=l_branch_2, Index=Slider(79, range=0..79), Wrap=True)

# ----
# PROCESADO PREVIO
#      DE LA IMAGEN
# RUTA Y VISUALIZACION
# IMAGEN EN JPG
path_2 = FilePath("G:\Mi unidad\ROBOT\Apps Robot  GH\1200 Tufting\Pruebas_Lorena\SUIZA\260618_FUNCIONA\NUEVA IMAGEN\Disegno Tuftbot_page-0001.jpg")

# ----
# VECTORIZACION IMAGEN
# Afinar con sliders
threshold = Slider(0.6, range=0..1)
vectorize_2 = Vectorize(
    Path=path_2,
    Threshold=threshold,
    Speckles=Slider(0, range=0..100),
    Corners=Slider(0, range=0..1.34),
    Tolerance=Slider(0.1, range=0..1),
    Border=Toggle(True))

len_5 = Length(Curve=vectorize_2)
sort_3 = SortList(Keys=len_5, ValuesA=vectorize_2)  # -> Keys, reverse(ValuesA)

# ----
# SMILES
panel_9 = Panel("""0
1""")
cull_i_2 = CullIndex(List=sort_3.ValuesA, Indices=panel_9, Wrap=True)

# ----
# CONTORNO
contorno_2 = ListItem(List=sort_3.ValuesA, Index=Slider(0, range=0..5), Wrap=True)

edgesdir_3 = EdgesFromDirections(Brep=contorno_2, Directions=X, Reflex=True, Angle=0)  # -> Edges, Indices, Map
edgesdir_4 = EdgesFromDirections(Brep=contorno_2, Directions=Y, Reflex=True, Angle=0)  # -> Edges, Indices, Map
area_5 = Area(Geometry=cull_i_2)  # -> Area, Centroid
len_6 = Length(Curve=edgesdir_3.Edges)
len_7 = Length(Curve=edgesdir_4.Edges)
alongcrv_2 = SortAlongCurve(Points=area_5.Centroid, Curve=contorno_2)  # -> Points, Indices
avr_4 = Average(Input=len_6)
avr_5 = Average(Input=len_7)
item_6 = ListItem(List=cull_i_2, Index=alongcrv_2.Indices, Wrap=True)
division_6 = Division(A=avr_5, B=avr_4)

multiplication_2 = Multiplication(A=avr_4, B=division_6)
rectangle_5 = Rectangle(Plane=PlaneXY(0, 0, 0), XSize=avr_4, YSize=multiplication_2, Radius=0)  # -> Rectangle, Length
panel_10 = Panel(multiplication_2)
img_2 = ImportImage(File=path_2, Rectangle=rectangle_5.Rectangle, XSamples=avr_4, YSamples=multiplication_2)

drec_2 = DeconstuctRectangle(Rectangle=contorno_2)  # -> BasePlane, XInterval, YInterval

# ----
# DIMENSIONES CANVAS
# SEGUN TAMAÑO DE LA
#                  IMAGEN
panel_11 = Panel(avr_4)
panel_12 = Panel(avr_5)

len_8 = Length(Curve=cull_i_2)
num_3 = Number(drec_2.XInterval)
num_4 = Number(drec_2.YInterval)
sort_4 = SortList(Keys=len_8, ValuesA=cull_i_2)  # -> Keys, ValuesA
division_7 = Division(A=num_3, B=number_slider_2)
division_8 = Division(A=num_4, B=number_slider_2)
cull_i_3 = CullIndex(List=sort_4.ValuesA, Indices=panel, Wrap=True)
round_3 = Round(Number=division_8)  # -> Nearest, Floor, Ceiling
round_4 = Round(Number=division_7)  # -> Nearest, Floor, Ceiling
debrep_2 = DeconstructBrep(Brep=contorno_2)  # -> Faces, Edges, Vertices
item_7 = ListItem(List=debrep_2.Vertices, Index=0, Wrap=True)
ptplanar_2 = PlanarGrid(
    BasePoint=item_7,
    IDir=Vector(1, 0, 0),
    JDir=Vector(0, 1, 0),
    IDistance=number_slider_2,
    JDistance=number_slider_2,
    INumber=round_3.Nearest,
    JNumber=round_4.Nearest)  # -> simplify(Grid)
crv_5 = Curve(cull_i_3)
bbox_3 = BoundingBox(Content=crv_5, Plane=PlaneXY(0, 0, 0))  # -> Box, Box_2
item_8 = ListItem(List=sort_4.ValuesA, Index=0, Wrap=True)  # -> Item, Item1
area_6 = Area(Geometry=bbox_3.Box)  # -> Area, Centroid
bbox_4 = BoundingBox(Content=[item_8.Item, item_8.Item1], Plane=PlaneXY(0, 0, 0))  # -> Box, Box_2
pdecon_4 = Deconstruct(Point=area_6.Centroid)  # -> XComponent, YComponent, ZComponent
debrep_3 = DeconstructBrep(Brep=bbox_4.Box)  # -> Faces, Edges, Vertices
sort_5 = SortList(Keys=pdecon_4.YComponent, ValuesA=crv_5)  # -> Keys, ValuesA
divlength = DivideLength(Curve=[item_8.Item, item_8.Item1], Length="5")  # -> simplify(Points), Tangents, Parameters
bbox_5 = BoundingBox(Content=sort_5.ValuesA, Plane=PlaneXY(0, 0, 0))  # -> Box, Box_2
# HILO BLANCO "SONRISAS"
divlength_2 = DivideLength(Curve=sort_5.ValuesA, Length="5")  # -> simplify(Points), Tangents, Parameters
debrep_4 = DeconstructBrep(Brep=bbox_5.Box)  # -> Faces, Edges, Vertices
cp_2 = ClosestPoint(Point=debrep_3.Vertices, Cloud=divlength.Points)  # -> simplify(ClosestPoint), CPIndex, Distance
cp_3 = ClosestPoint(Point=debrep_4.Vertices, Cloud=divlength_2.Points)  # -> simplify(ClosestPoint), CPIndex, Distance
pdecon_5 = Deconstruct(Point=cp_2.ClosestPoint)  # -> XComponent, YComponent, ZComponent
pdecon_6 = Deconstruct(Point=cp_3.ClosestPoint)  # -> XComponent, YComponent, ZComponent
sort_6 = SortList(Keys=pdecon_5.XComponent, ValuesA=cp_2.ClosestPoint)  # -> Keys, ValuesA
bang = ExplodeTree(Data=sort_6.ValuesA)  # -> Branch0, Branch1
sort_7 = SortList(Keys=pdecon_6.XComponent, ValuesA=cp_3.ClosestPoint)  # -> Keys, ValuesA
item_9 = ListItem(List=bang.Branch0, Index=panel_3, Wrap=True)
item_10 = ListItem(List=bang.Branch1, Index=panel_4, Wrap=True)
item_11 = ListItem(List=sort_7.ValuesA, Index=panel_2, Wrap=True)
stack = StackTrees(Data0=item_9, Data1=item_10, Reduce=True)
curveshatter = CurveShatter(Curve=graft(sort_5.ValuesA), Points=item_11, Tolerance=0.01)  # -> simplify(Curves)
stack_2 = StackTrees(Data0=item_8.Item, Data1=item_8.Item1, Reduce=True)
curveshatter_2 = CurveShatter(Curve=stack_2, Points=stack, Tolerance=0.01)  # -> simplify(Curves)
ext = ExtendCurve(Curve=curveshatter, Type=0, Start="-15", End="-15")
dispatch_2 = Dispatch(List=ext, DispatchPattern=[True, False])  # -> ListA, ListB
end = EndPoints(Curve=dispatch_2.ListA)  # -> Start, End
end_2 = EndPoints(Curve=dispatch_2.ListB)  # -> Start, End
ln = Line(StartPoint=end.Start, EndPoint=end_2.End)
ln_2 = Line(StartPoint=end.End, EndPoint=end_2.Start)
item_12 = ListItem(List=ext, Index=0, Wrap=True)
ext_2 = ExtendCurve(Curve=curveshatter_2, Type=0, Start="-15", End="-15")
dispatch_3 = Dispatch(List=ext_2, DispatchPattern=[True, False])  # -> ListA, ListB
end_3 = EndPoints(Curve=dispatch_3.ListA)  # -> Start, End
end_4 = EndPoints(Curve=dispatch_3.ListB)  # -> Start, End
ln_3 = Line(StartPoint=end_3.Start, EndPoint=end_4.End)
ln_4 = Line(StartPoint=end_3.End, EndPoint=end_4.Start)
flip = FlipCurve(Curve=ext, Guide=item_12)  # -> Curve, Flag
join_2 = JoinCurves(Curves=[ext, ln, ln_2], Preserve=False)  # -> simplify(Curves)
join_3 = JoinCurves(Curves=[ext_2, ln_3, ln_4], Preserve=False)  # -> simplify(Curves)
item_13 = ListItem(List=ext_2, Index=0, Wrap=True)
flip_2 = FlipCurve(Curve=ext_2, Guide=item_13)  # -> Curve, Flag

item_14 = ListItem(List=flip.Curve, Index=0, Wrap=True)  # -> Item, Item1
tweencrv = TweenCurve(CurveA=item_14.Item, CurveB=item_14.Item1, Factor=0.5, BlendType=0)

offset = OffsetCurve(Curve=[join_2, join_3], Distance="3", Corners="3")  # -> simplify(flatten(Curve))

item_15 = ListItem(List=flip_2.Curve, Index=0, Wrap=True)  # -> Item, Item1
tweencrv_2 = TweenCurve(CurveA=item_15.Item, CurveB=item_15.Item1, Factor=0.5, BlendType=0)

graft = GraftTree(Tree=offset, IncludeEmptyLists=True, IncludeNullItems=True)  # -> simplify(Tree)
merge_2 = Merge(Data1=item_14.Item, Data2=tweencrv, Data3=item_14.Item1)
merge_3 = Merge(Data1=item_15.Item, Data2=tweencrv_2, Data3=item_15.Item1)

# ----
# ELIMINAR PUNTOS
# DENTRO DE SONRISAS
panel_13 = Panel("0")
cull_i_4 = CullIndex(List=ptplanar_2, Indices=panel_13, Wrap=True)
cull_branch = CullBranch(T=cull_i_4, I=panel_13)
renumber_2 = RenumberPaths(Data=cull_branch)
number_slider_10 = Slider(1, range=1..5)
flatten_2 = FlattenTree(Tree=renumber_2, Path="{0}")
boundary_2 = BoundarySurfaces(Edges=graft)
neg_3 = Negative(Value=number_slider_10)
offsrf_3 = OffsetSurface(Surface=boundary_2, Distance=number_slider_10, BothSides=neg_3, CreateSolid=True)
brepinc_2 = PointInBrep(Brep=simplify(offsrf_3), Point=flatten_2, Strict=False)
dispatch_4 = Dispatch(List=flatten_2, DispatchPattern=brepinc_2)  # -> ListA, ListB
cp_4 = ClosestPoint(Point=flatten(dispatch_4.ListA), Cloud=flatten(renumber_2))  # -> ClosestPoint, simplify(CPIndex), Distance
cull_i_5 = CullIndex(List=simplify(flatten(renumber_2)), Indices=cp_4.CPIndex, Wrap=True)

explode_2 = Explode(Curve=merge_2, Recursive=True)  # -> Segments, simplify(Vertices)
explode_3 = Explode(Curve=merge_3, Recursive=True)  # -> Segments, simplify(Vertices)
lng_4 = ListLength(List=explode_2.Vertices)
lng_5 = ListLength(List=explode_3.Vertices)
trim = TrimTree(Tree=lng_4, Depth=1)
# HILO MARRON "INFILL"
trim_2 = TrimTree(Tree=lng_5, Depth=1)
reb = RebuildCurve(Curve=merge_3, Degree="3", Count=trim_2, Tangents=False)
reb_2 = RebuildCurve(Curve=merge_2, Degree="3", Count=trim, Tangents=False)
stack_3 = StackTrees(Data0=reb_2, Data1=reb, Reduce=True)

# ----
# Áreas detectadas y orden
number_slider_11 = Slider(4, range=0..7)
l_branch_3 = ListBranch(T=stack_3, i=number_slider_11)

pline_2 = PolyLine(Vertices=cull_i_5, Closed=invert(False))
explode_4 = Explode(Curve=pline_2, Recursive=True)  # -> Segments, Vertices

# ----
# ORDENAR DIRECCIONES DE TEJIDO
# Test vector
number_slider_12 = Slider(0, range=0..1)
crv_6 = Curve(explode_4.Segments)
vec_2 = VectorXYZ(XComponent=Slider(1, range=0..1), YComponent=number_slider_12, ZComponent=Slider(0, range=0..1))  # -> Vector, Length
unit_2 = UnitVector(Vector=crv_6)
xy_2 = XYPlane(Origin=Point(0, 0, 0))
angle_2 = Angle(VectorA=vec_2.Vector, VectorB=unit_2, Plane=xy_2)  # -> simplify(Angle), Reflex
deg_2 = Degrees(Radians=angle_2.Angle)
smaller_2 = SmallerThan(FirstNumber=deg_2, SecondNumber=Slider(1, range=1..90))  # -> SmallerThan, OrEqualTo
cull_3 = CullPattern(List=crv_6, CullPattern=smaller_2.SmallerThan)  # -> simplify(List)
clean_2 = CleanTree(RemoveNulls=True, RemoveInvalid=True, RemoveEmpty=invert(False), Tree=cull_3)  # -> simplify(Tree)
renumber_3 = RenumberPaths(Data=clean_2)
join_4 = JoinCurves(Curves=renumber_3, Preserve=False)  # -> simplify(Curves)
midpt_2 = CurveMiddle(Curve=join_4)
pdecon_7 = Deconstruct(Point=midpt_2)  # -> XComponent, YComponent, ZComponent
sort_8 = SortList(Keys=pdecon_7.XComponent, ValuesA=join_4)  # -> Keys, ValuesA
crv_7 = Curve(sort_8.ValuesA)
ccx = CurveCurve(CurveA=graft, CurveB=crv_7)  # -> simplify(Points), ParamsA, ParamsB
curveshatter_3 = CurveShatter(Curve=crv_7, Points=flatten(ccx.Points), Tolerance=0.01)  # -> simplify(Curves)
midpt_3 = CurveMiddle(Curve=curveshatter_3)
brepinc_3 = PointInBrep(Brep=simplify(offsrf_3), Point=flatten(midpt_3), Strict=False)
cull_4 = CullPattern(List=flatten(curveshatter_3), CullPattern=brepinc_3)
midpt_4 = CurveMiddle(Curve=cull_4)  # -> flatten(Midpoint)
cp_5 = ClosestPoint(Point=flatten(midpt_4), Cloud=flatten(midpt_3))  # -> ClosestPoint, CPIndex, Distance
cull_i_6 = CullIndex(List=flatten(curveshatter_3), Indices=cp_5.CPIndex, Wrap=True)

# ----
# LINEAS HORIZONTALES
# DE INFILL MARRON
join_crvs_with_tolerance = JoinCrvsWithTolerance(crvs=cull_i_6, tol=Slider(2, range=1..7))

end_5 = EndPoints(Curve=join_crvs_with_tolerance)  # -> Start, End
pdecon_8 = Deconstruct(Point=end_5.Start)  # -> XComponent, YComponent, ZComponent
multiplication_3 = Multiplication(A=pdecon_8.YComponent, B="1000")
addition = Addition(A=multiplication_3, B=pdecon_8.XComponent)
sort_9 = SortList(Keys=addition, ValuesA=join_crvs_with_tolerance)  # -> Keys, ValuesA

# ----
# ELIMINAR LONGITUDES PEQUEÑAS
eliminar_longitudes_2 = Panel("20")
len_9 = Length(Curve=sort_9.ValuesA)
larger_2 = LargerThan(FirstNumber=len_9, SecondNumber=eliminar_longitudes_2)  # -> LargerThan, OrEqualTo
cull_5 = CullPattern(List=sort_9.ValuesA, CullPattern=larger_2.LargerThan)

# ----
# AGRUPAR TROZOS HORIZONTALES
end_6 = EndPoints(Curve=cull_5)  # -> Start, End
pdecon_9 = Deconstruct(Point=end_6.Start)  # -> XComponent, YComponent, ZComponent
# INTERNALIZAR Y COPIAR
# AL SIGUIENTE ARCHIVO
#               KUKA PRC
cset = CreateSet(List=pdecon_9.YComponent)  # -> Set, simplify(Map)
branch_by_key = BranchByKey(Sort=invert(True), Key=cset.Map, List=cull_5)  # -> None, Key, List

# ==== cluster ListBranch: Select a specific branch from tree
T = ClusterInput()
i = ClusterInput()
T_2 = Data(T)
tstat = TreeStatistics(Tree=T_2)  # -> Paths, Length, Count
item = ListItem(List=tstat.Paths, Index=i, Wrap=True)
branch = TreeBranch(Tree=T_2, Path=item, MaintainPaths=True)
B = ClusterOutput(branch)

# ==== cluster JoinCrvsWithTolerance: Join Curves with tolerance
crvs = ClusterInput()
tol = ClusterInput()
python = GhPythonScript(crvs=crvs, tol=tol)  # -> out, joined_crvs; inputs crvs: list of Curve
# ---------- python: Python ----------
__author__ = "Lorena"
__version__ = "2025.11.13"

import rhinoscriptsyntax as rs
import Rhino.Geometry as rg

j_crvs = rg.Curve.JoinCurves(crvs, tol)
joined_crvs = [crv for crv in j_crvs]
# ---------- end python ----------
joined_crvs = ClusterOutput(python.joined_crvs)

# ==== cluster CullBranch
T = ClusterInput()
I = ClusterInput()
T_2 = Data(T)
tstat = TreeStatistics(Tree=T_2)  # -> Paths, Length, Count
cull_i = CullIndex(List=tstat.Paths, Indices=I, Wrap=True)
branch = TreeBranch(Tree=T_2, Path=cull_i, MaintainPaths=True)
B = ClusterOutput(branch)
