# Grasshopper definition 02_TUFTING_KUKA_PRC.gh (Grasshopper 1.0.8)
# plug-ins: treesloth01, KUKA|prc - parametric robot control

# GEOMETRY FROM
# PREVIOUSLY FILE
sonrisas = Curve(Tree({0}: [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], {1}: [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], {2}: [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], {3}: [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], {4}: [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], {5}: [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], {6}: [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], {7}: [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]))
curvas_horizontales = Curve(Tree({0}: [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], {1}: [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], {2}: [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], {3}: [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], {4}: [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], {5}: [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]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))
number_slider = Slider(-90, range=-90..0)
rotate = Rotate(Geometry=sonrisas, Angle=degrees(number_slider), Plane=PlaneXY(0, 0, 0))  # -> Geometry, Transform
rotate_2 = Rotate(Geometry=curvas_horizontales, Angle=degrees(number_slider), Plane=PlaneXY(0, 0, 0))  # -> Geometry, Transform
tstat = TreeStatistics(Tree=rotate.Geometry)  # -> Paths, Length, Count
l_branch = ListBranch(T=rotate.Geometry, i="-1")
flip = FlipCurve(Curve=l_branch)  # -> Curve, Flag
cull_branch = CullBranch(T=rotate.Geometry, I="-1")
stack = StackTrees(Data0=cull_branch, Data1=flip.Curve, Reduce=True)
Y = UnitY(Factor="400")
Y_2 = UnitY(Factor="400")
move = Move(Geometry=stack, Motion=Y)  # -> Geometry, Transform
move_2 = Move(Geometry=rotate_2.Geometry, Motion=Y_2)  # -> Geometry, Transform

# ----
# DISPLACEMENT FOR
# CURVES AND CANVA
number_slider_2 = Slider(20, range=0..100)

X = UnitX(Factor=number_slider_2)
Y_3 = UnitY(Factor=Slider(0, range=0..100))
addition = Addition(A=X, B=Y_3)

move_3 = Move(Geometry=move.Geometry, Motion=addition)  # -> Geometry, Transform
move_4 = Move(Geometry=move_2.Geometry, Motion=addition)  # -> Geometry, Transform

topoly = CurveToPolyline(Curve=move_4.Geometry, ToleranceDistance=0, ToleranceAngle=0, MaxEdge="30")  # -> Polyline, Segments
topoly_2 = CurveToPolyline(Curve=move_3.Geometry, ToleranceDistance="0.02", ToleranceAngle=0, MaxEdge="5")  # -> Polyline, Segments
pcol = PolylineCollapse(Polyline=topoly.Polyline, Tolerance="15")  # -> simplify(Polyline), Count
pcol_2 = PolylineCollapse(Polyline=topoly_2.Polyline, Tolerance="3")  # -> simplify(graft(Polyline)), Count
renumber = RenumberPaths(Data=pcol_2.Polyline)
renumber_2 = RenumberPaths(Data=pcol.Polyline)
explode = Explode(Curve=renumber, Recursive=True)  # -> Segments, Vertices
bbox = BoundingBox(Content=flatten(renumber_2), Plane=PlaneXY(0, 0, 0), UnionBox=True)  # -> Box, Box_2
bbox_2 = BoundingBox(Content=flatten(renumber), Plane=PlaneXY(0, 0, 0), UnionBox=True)  # -> Box, Box_2
explode_2 = Explode(Curve=renumber_2, Recursive=True)  # -> Segments, Vertices
explode_3 = Explode(Curve=renumber, Recursive=True)  # -> Segments, Vertices
cull_i = CullIndex(List=explode.Vertices, Indices="-1", Wrap=True)
# DATO QUE SE OBTIENE DE
# KUKA PRC->ANALYSIS.
# El nº que marca el total del gráfico
panel = Panel("3700")
end = EndPoints(Curve=renumber_2)  # -> Start, End
pl_origin = PlaneOrigin(Base=bbox.Box, Origin=explode_2.Vertices)  # -> simplify(Plane)
# GUN ORIENTATION FOR
# EACH CURVE DIRECTION
pl_origin_2 = PlaneOrigin(Base=bbox_2.Box, Origin=explode_3.Vertices)
shift = ShiftList(List=explode.Vertices, Shift=1, Wrap=invert(True))
division = Division(A=panel, B="3600")
tstat_2 = TreeStatistics(Tree=pl_origin)  # -> Paths, Length, Count
vec2pt = Vector2Pt(PointA=end.Start, PointB=end.End, Unitize=False)  # -> Vector, Length
vec2pt_2 = Vector2Pt(PointA=cull_i, PointB=shift, Unitize=False)  # -> Vector, Length
duracion_horas = Panel(division)
srf = Surface(<surface referenced from the Rhino model>)

preview = CustomPreview(Geometry=move_3.Geometry, Material=ColourSwatch(SwatchColor=RGB(255, 255, 255)))
preview_2 = CustomPreview(Geometry=move_4.Geometry, Material=ColourSwatch(SwatchColor=RGB(105, 30, 30)))
preview_3 = CustomPreview(Geometry=srf, Material=ColourSwatch(SwatchColor=RGB(120, 119, 119)))

item = ListItem(List=vec2pt_2.Vector, Index="-1", Wrap=True)
repeat = RepeatData(Data=vec2pt.Vector, Length=graft(tstat_2.Length))
match = MatchTree(Tree=repeat, Guide=pl_origin)
ins = InsertItems(List=vec2pt_2.Vector, Item=item, Indices="-1", Wrap=True)
align = AlignPlane(Plane=pl_origin, Direction=match)  # -> Plane, Angle
match_2 = MatchTree(Tree=ins, Guide=pl_origin_2)
align_2 = AlignPlane(Plane=pl_origin_2, Direction=match_2)  # -> Plane, Angle
prot = RotatePlane(Plane=align_2.Plane, Angle=degrees(Slider(-90, range=-90..90)))
prot_2 = RotatePlane(Plane=align.Plane, Angle=degrees(Slider(-90, range=-90..90)))
dam = DataDam(DataA=prot_2, BufferDelay=10000000, BufferMode=0)
# PUSH PLAY AFTER
# EACH CHANGE
dam_2 = DataDam(DataA=prot, BufferDelay=10000000, BufferMode=0)

# ----
# INITIAL POINT CALIBRATION
# AT CORNER OF CANVA
Y_4 = UnitY(Factor=1)
X_2 = UnitX(Factor=1)
pt = Point(<point referenced from the Rhino model>)
neg = Negative(Value=Y_4)
pl = ConstructPlane(Origin=pt, XAxis=neg, YAxis=X_2)
wait_at_finish = Panel("1")
wait = WaitKUKAPrc(KUKAPrcWait=wait_at_finish)
ptp_move = PTPMovementKUKAPrc(TargetAsPlane=pl, StatusTurn="110", Speed="10", extaxenabled=False, interpolation="C_PTP")
ins_2 = InsertItems(List=ptp_move, Item=wait, Indices="-1", Wrap=True)
panel_2 = Panel(ins_2)

_0_and_1_approach_distance = Panel("-100")

# ----
# OUTPUT PIN FOR
# TUFTING GUN
dotuft = Panel("4")

# ----
# OUTPUT PIN FOR
# TUFTING GUN
dotuft_2 = Panel("4")

# ----
# OUTPUT PIN FOR
# GREEN LIGHT
pin = Panel("3")

# ----
# OUTPUT PIN FOR
# GREEN LIGHT
pin_2 = Panel("3")

Z = UnitZ(Factor=_0_and_1_approach_distance)
neg_2 = Negative(Value=Z)

digital_out = DigitalOutputKUKAPrc(DigitalOutputNumber=pin_2, OutputState=Toggle(True), ContinuousMovement=False, ToolState=-1)
digital_out_2 = DigitalOutputKUKAPrc(DigitalOutputNumber=pin_2, OutputState=Toggle(False), ContinuousMovement=False, ToolState=-1)

# ----
# ON/OFF
# TUFTING GUN
toggle = BooleanToggle(False)
digital_out_3 = DigitalOutputKUKAPrc(DigitalOutputNumber=dotuft, OutputState=Toggle(True), ContinuousMovement=False, ToolState=-1)
digital_out_4 = DigitalOutputKUKAPrc(DigitalOutputNumber=dotuft, OutputState=toggle, ContinuousMovement=False, ToolState=-1)

digital_out_5 = DigitalOutputKUKAPrc(DigitalOutputNumber=pin, OutputState=Toggle(True), ContinuousMovement=False, ToolState=-1)
digital_out_6 = DigitalOutputKUKAPrc(DigitalOutputNumber=pin, OutputState=Toggle(False), ContinuousMovement=False, ToolState=-1)

# ----
# ON/OFF
# TUFTING GUN
toggle_2 = BooleanToggle(False)
digital_out_7 = DigitalOutputKUKAPrc(DigitalOutputNumber=dotuft_2, OutputState=Toggle(True), ContinuousMovement=False, ToolState=-1)
digital_out_8 = DigitalOutputKUKAPrc(DigitalOutputNumber=dotuft_2, OutputState=toggle_2, ContinuousMovement=False, ToolState=-1)

# ----
# OUTPUT PIN FOR
# RED LIGHT
pin_3 = Panel("4")

# ----
# OUTPUT PLANE
panel_3 = Panel("-1")
item_2 = ListItem(List=dam_2, Index=panel_3, Wrap=True)
move_5 = Move(Geometry=item_2, Motion=neg_2)  # -> Geometry, Transform
wait_at_finish_2 = Panel("0.5")
linear_movement_kuka_prc = LINearMovementKUKAPrc(TargetAsPlane=move_5.Geometry, Speed="0.1", extaxenabled=False, interpolation="C_DIS")
wait_2 = WaitKUKAPrc(KUKAPrcWait=wait_at_finish_2)
ins_3 = InsertItems(List=linear_movement_kuka_prc, Item=wait_2, Indices="-1", Wrap=True)
pshift = ShiftPaths(Data=ins_3, Offset=-1)

# ----
# INPUT PLANE
item_3 = ListItem(List=dam_2, Index=0, Wrap=True)
move_6 = Move(Geometry=item_3, Motion=neg_2)  # -> Geometry, Transform
wait_at_finish_3 = Panel("0.5")
linear_movement_kuka_prc_2 = LINearMovementKUKAPrc(TargetAsPlane=move_6.Geometry, Speed="0.1", extaxenabled=False, interpolation="C_DIS")
wait_3 = WaitKUKAPrc(KUKAPrcWait=wait_at_finish_3)
ins_4 = InsertItems(List=linear_movement_kuka_prc_2, Item=wait_3, Indices="-1", Wrap=True)
pshift_2 = ShiftPaths(Data=ins_4, Offset=-1)

# ----
# WHITE COLOUR BLOCK
wait_in_out_canva = Panel("1")
linear_movement_kuka_prc_3 = LINearMovementKUKAPrc(TargetAsPlane=dam_2, Speed="0.04", extaxenabled=False, interpolation="C_DIS")
wait_4 = WaitKUKAPrc(KUKAPrcWait=wait_in_out_canva)
wait_5 = WaitKUKAPrc(KUKAPrcWait=wait_in_out_canva)
merge = Merge(Data1=wait_4, Data2=digital_out_5, Data3=digital_out_3)
merge_2 = Merge(Data1=digital_out_4, Data2=digital_out_6, Data3=wait_5)
ins_5 = InsertItems(List=linear_movement_kuka_prc_3, Item=merge, Indices="1", Wrap=True)
pshift_3 = ShiftPaths(Data=linear_movement_kuka_prc_3, Offset="-1")
pshift_4 = ShiftPaths(Data=ins_5, Offset=-1)
replace = ReplaceItems(List=pshift_3, Item=pshift_4, Indices="0", Wrap=False)
pshift_5 = ShiftPaths(Data=replace, Offset="-2")
ins_6 = InsertItems(List=pshift_5, Item=merge_2, Indices="-1", Wrap=True)
merge_3 = Merge(Data1=ins_2, Data2=pshift_2, Data3=ins_6, Data4=pshift)

# ----
# INPUT PIN FOR
# BUTTOM
cambio_hilo_color = Panel("1")

digital_out_9 = DigitalOutputKUKAPrc(DigitalOutputNumber=pin_3, OutputState=Toggle(True), ContinuousMovement=False, ToolState=-1)
digital_out_10 = DigitalOutputKUKAPrc(DigitalOutputNumber=pin_3, OutputState=Toggle(False), ContinuousMovement=False, ToolState=-1)

renumber_3 = RenumberPaths(Data=merge_3)
tufting_gun = Brep(<brep referenced from the Rhino model>)
mesh = MeshBrep(
    Brep=tufting_gun,
    Settings={GridMaxCount=0, GridMinCount=16, JaggedSeams=False, MaxEdgeLength=0, MinEdgeLength=0.0001, MinTolerance=0, Refine=True, RefineAngle=0, RelativeTolerance=0.65, SimplePlanes=True, Tolerance=0})

# ----
# SIMULATION SLIDER
number_slider_3 = Slider(0.14012, range=0..1)

custom_tool_kuka_prc = CustomToolKUKAPrc(
    CustomToolGeometry=mesh,
    isExternal=False,
    toolid=2,
    toolvala=0,
    toolvalb=-90,
    toolvalc=90,
    toolvalx=-30,
    toolvaly=0,
    toolvalz=297,
    valuesset=True)
kr6_16_20_3_robot = KR616203Robot(infiniterot=False)

# ----
# WHITE WOOL
# 2000 mm/130 mm
# 
# ? mm/1000 mm
# 
# FACTOR = 2000/130 = 15,38 --> ROUNDED TO 15,5
metros_bobina = Panel("500")

cluster = Cluster(B="25", B_2=metros_bobina, C=pcol_2.Polyline)  # -> R, R_2, C_2

metros_lana_reales = Panel(cluster.R)
metros_lana_s_factor = Panel(cluster.R_2)
bobinas = Panel(cluster.C_2)

# ----
# BROWN WOOL
# 2000 mm/130 mm
# 
# ? mm/1000 mm
# 
# FACTOR = 2000/130 = 15,38 --> ROUNDED TO 15,5
metros_bobina_2 = Panel("500")

cluster_2 = Cluster(B="25", B_2=metros_bobina_2, C=pcol.Polyline)  # -> R, R_2, C_2

metros_lana_reales_2 = Panel(cluster_2.R)
bobinas_2 = Panel(cluster_2.C_2)
metros_lana_s_factor_2 = Panel(cluster_2.R_2)

# ----
# POSITION AND STOP
# FOR CHANGE YARN
panel_4 = Panel("-1")
l_branch_2 = ListBranch(T=move_5.Geometry, i=panel_4)
pdecon = Deconstruct(Point=l_branch_2)  # -> XComponent, YComponent, ZComponent
pt_2 = ConstructPoint(XCoordinate=pdecon.XComponent, YCoordinate=pdecon.YComponent, ZCoordinate="150")
Y_5 = UnitY(Factor=1)
X_3 = UnitX(Factor=1)
neg_3 = Negative(Value=Y_5)
pl_2 = ConstructPlane(Origin=pt_2, XAxis=neg_3, YAxis=X_3)
wait_for = WaitForDigitalInputKUKAPrc(DigitalInput=cambio_hilo_color)
merge_4 = Merge(Data1=digital_out_9, Data2=wait_for, Data3=digital_out_10)

# ----
# BROWN COLOUR BLOCK
_0_and_1_approach_distance_2 = Panel("-100")
wait_in_out_canva_2 = Panel("1")
Z_2 = UnitZ(Factor=_0_and_1_approach_distance_2)
neg_4 = Negative(Value=Z_2)
linear_movement_kuka_prc_4 = LINearMovementKUKAPrc(TargetAsPlane=dam, Speed="0.04", extaxenabled=False, interpolation="C_DIS")
wait_6 = WaitKUKAPrc(KUKAPrcWait=wait_in_out_canva_2)
wait_7 = WaitKUKAPrc(KUKAPrcWait=wait_in_out_canva_2)
merge_5 = Merge(Data1=wait_6, Data2=digital_out, Data3=digital_out_7)
merge_6 = Merge(Data1=digital_out_8, Data2=digital_out_2, Data3=wait_7)
ins_7 = InsertItems(List=linear_movement_kuka_prc_4, Item=merge_5, Indices="1", Wrap=True)
pshift_6 = ShiftPaths(Data=ins_7, Offset="-1")
pshift_7 = ShiftPaths(Data=linear_movement_kuka_prc_4, Offset="-1")
replace_2 = ReplaceItems(List=linear_movement_kuka_prc_4, Item=pshift_6, Indices="0", Wrap=False)
panel_5 = Panel("-2")
pshift_8 = ShiftPaths(Data=replace_2, Offset="-1")
ins_8 = InsertItems(List=pshift_8, Item=merge_6, Indices="-1", Wrap=True)

item_4 = ListItem(List=dam, Index=0, Wrap=True)
move_7 = Move(Geometry=item_4, Motion=neg_4)  # -> Geometry, Transform
wait_at_finish_4 = Panel("0.5")
linear_movement_kuka_prc_5 = LINearMovementKUKAPrc(TargetAsPlane=move_7.Geometry, Speed="0.1", extaxenabled=False, interpolation="C_DIS")
wait_8 = WaitKUKAPrc(KUKAPrcWait=wait_at_finish_4)
ins_9 = InsertItems(List=linear_movement_kuka_prc_5, Item=wait_8, Indices="-1", Wrap=True)
pshift_9 = ShiftPaths(Data=ins_9, Offset=-1)

item_5 = ListItem(List=dam, Index="-1", Wrap=True)
move_8 = Move(Geometry=item_5, Motion=neg_4)  # -> Geometry, Transform
wait_at_finish_5 = Panel("0.5")
linear_movement_kuka_prc_6 = LINearMovementKUKAPrc(TargetAsPlane=move_8.Geometry, Speed="0.1", extaxenabled=False, interpolation="C_DIS")
wait_9 = WaitKUKAPrc(KUKAPrcWait=wait_at_finish_5)
ins_10 = InsertItems(List=linear_movement_kuka_prc_6, Item=wait_9, Indices="-1", Wrap=True)
pshift_10 = ShiftPaths(Data=ins_10, Offset=-1)

lin_move = LINearMovementKUKAPrc(TargetAsPlane=pl_2, Speed="0.04", extaxenabled=False, interpolation="C_DIS")
ins_11 = InsertItems(List=lin_move, Item=merge_4, Indices="-1", Wrap=True)

merge_7 = Merge(Data1=ins_9, Data2=ins_8, Data3=ins_10)

pshift_11 = ShiftPaths(Data=merge_7, Offset="-2")
stack_2 = StackTrees(Data0=renumber_3, Data1=ins_11, Data2=pshift_11, Reduce=True)
renumber_4 = RenumberPaths(Data=stack_2)
# ENABLE/DISABLE
# TO DISPLAY ROBOT
kuka_prc_core = KUKAPrcCORE(
    SimulationSlider=number_slider_3,
    KUKAPrcCommands=flatten(renumber_4),
    Tool=custom_tool_kuka_prc,
    Robot=kr6_16_20_3_robot,
    SaveToggle=Button(),
    Filename="tuft_2cm",
    PRC_BaseExpose=False,
    PRC_SaveNameExpose=True,
    PRCsettings="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")  # -> RobotGeometry, AnalysisOutput

# ==== cluster CullBranch
T = ClusterInput()
I = ClusterInput()
T_2 = Data(T)
tstat = TreeStatistics(Tree=T_2)  # -> Paths, Length, Count
cull_i = CullIndex(List=tstat.Paths, Indices=I, Wrap=True)
branch = TreeBranch(Tree=T_2, Path=cull_i, MaintainPaths=True)
B = ClusterOutput(branch)

# ==== cluster ListBranch: Select a specific branch from tree
T = ClusterInput()
i = ClusterInput()
T_2 = Data(T)
tstat = TreeStatistics(Tree=T_2)  # -> Paths, Length, Count
item = ListItem(List=tstat.Paths, Index=i, Wrap=True)
branch = TreeBranch(Tree=T_2, Path=item, MaintainPaths=True)
B = ClusterOutput(branch)

# ==== cluster Cluster
B = ClusterInput()
C = ClusterInput()
B_2 = ClusterInput()
len = Length(Curve=C)
flatten = FlattenTree(Tree=len, Path="{0}")
ma = MassAddition(Input=flatten)  # -> Result, PartialResults
division = Division(A=ma.Result, B=1000)
roundd = RoundToDecimalPlace(NumberX=division, DecimalPlace="2", RoundType=0)  # -> Rounded, Difference
multiplication = Multiplication(A=ma.Result, B=B)
division_2 = Division(A=multiplication, B=1000)
division_3 = Division(A=division_2, B=B_2)
roundd_2 = RoundToDecimalPlace(NumberX=division_2, DecimalPlace="2", RoundType=0)  # -> Rounded, Difference
round = Round(Number=division_3)  # -> Nearest, Floor, Ceiling
R = ClusterOutput(roundd.Rounded)
R_2 = ClusterOutput(roundd_2.Rounded)
C_2 = ClusterOutput(round.Ceiling)
