# Grasshopper definition DGF_HEX.gh (Grasshopper 1.0.8)

f1 = Curve(<curve referenced from the Rhino model>)
f3 = Curve(<curve referenced from the Rhino model>)
f2 = Curve(<curve referenced from the Rhino model>)

d_hex = Curve(<curve referenced from the Rhino model>)
e_hex = Curve(<curve referenced from the Rhino model>)
f_hex = Curve(<curve referenced from the Rhino model>)
g_hex = Curve(<curve referenced from the Rhino model>)

d1 = Curve(<curve referenced from the Rhino model>)
d2 = Curve(<curve referenced from the Rhino model>)
d3 = Curve(<curve referenced from the Rhino model>)

e1 = Curve(<curve referenced from the Rhino model>)
e2 = Curve(<curve referenced from the Rhino model>)
e3 = Curve(<curve referenced from the Rhino model>)

g1 = Curve(<curve referenced from the Rhino model>)
g2 = Curve(<curve referenced from the Rhino model>)
g3 = Curve(<curve referenced from the Rhino model>)

cluster = Cluster(
    hexagono_d=d_hex,
    hexagono_e=e_hex,
    hexagono_f=f_hex,
    hexagono_g=g_hex,
    N="5",
    d_inner_line_1=d1,
    d_inner_line_2=d2,
    d_inner_line_3=d3,
    e_inner_line_1=e1,
    e_inner_line_2=e2,
    e_inner_line_3=e3,
    f_inner_line_1=f1,
    f_inner_line_2=f2,
    f_inner_line_3=f3,
    g_inner_line_1=g1,
    g_inner_line_2=g2,
    g_inner_line_3=g3)  # -> d_contour_2, e_contour_2, f_contour_2, g_contour_2, T_3, T, T_2, T_4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

d_contour = Curve(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)
f_contour = Curve(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)
g_contour = Curve(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)

d_waves = Curve(Tree({0}: [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], {1}: [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], {2}: [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]))
g_waves = Curve(Tree({0}: [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], {1}: [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], {2}: [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]))
f_waves = Curve(Tree({0}: [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], {1}: [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], {2}: [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]))

f_infill = Curve(Tree({0}: [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], {1}: [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], {2}: [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], {3}: [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], {4}: [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], {5}: [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]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))
d_infill = Curve(Tree({0}: [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], {1}: [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], {2}: [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], {3}: [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], {4}: [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], {5}: [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]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))
g_infill = Curve(Tree({0}: [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], {1}: [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], {2}: [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], {3}: [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], {4}: [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], {5}: [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]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))

# ==== cluster Cluster
hexagono_d = ClusterInput()
hexagono_e = ClusterInput()
hexagono_f = ClusterInput()
hexagono_g = ClusterInput()
N = ClusterInput()
hexagono_d_2 = Curve(hexagono_d)
hexagono_e_2 = Curve(hexagono_e)
hexagono_f_2 = Curve(hexagono_f)
hexagono_g_2 = Curve(hexagono_g)
g_inner_line_3 = ClusterInput()
d_inner_line_1 = ClusterInput()
d_inner_line_2 = ClusterInput()
d_inner_line_3 = ClusterInput()
e_inner_line_3 = ClusterInput()
f_inner_line_3 = ClusterInput()
g_inner_line_1 = ClusterInput()
g_inner_line_2 = ClusterInput()
e_inner_line_1 = ClusterInput()
f_inner_line_1 = ClusterInput()
e_inner_line_2 = ClusterInput()
f_inner_line_2 = ClusterInput()
merge = Merge(Data1=hexagono_d_2, Data2=hexagono_e_2, Data3=hexagono_f_2, Data4=hexagono_g_2)  # -> simplify(graft(Result))
e_inner_line_1_2 = Curve(e_inner_line_1)
e_inner_line_2_2 = Curve(e_inner_line_2)
e_inner_line_3_2 = Curve(e_inner_line_3)
g_inner_line_1_2 = Curve(g_inner_line_1)
g_inner_line_2_2 = Curve(g_inner_line_2)
g_inner_line_3_2 = Curve(g_inner_line_3)
f_inner_line_1_2 = Curve(f_inner_line_1)
f_inner_line_2_2 = Curve(f_inner_line_2)
f_inner_line_3_2 = Curve(f_inner_line_3)
d_inner_line_1_2 = Curve(d_inner_line_1)
d_inner_line_2_2 = Curve(d_inner_line_2)
d_inner_line_3_2 = Curve(d_inner_line_3)
neg = Negative(Value=N)
division = Division(A=neg, B="2")
offset = OffsetCurve(Curve=merge, Distance=division, Corners=1)
bbox = BoundingBox(Content=offset, Plane=PlaneXY(0, 0, 0))  # -> Box, Box_2
debrep = DeconstructBrep(Brep=bbox.Box)  # -> Faces, Edges, Vertices
item = ListItem(List=debrep.Edges, Index="0", Wrap=True)
item_2 = ListItem(List=debrep.Edges, Index="2", Wrap=True)
midpt = CurveMiddle(Curve=item)

# ----
# CONTORNOS
panel = Panel("0")
seam_creator = SeamCreator(curve=offset, gate=panel, stream=midpt, start_reduction=division, end_reduction=division)  # -> simplify(curve_2)
flip = FlipCurve(Curve=seam_creator)  # -> Curve, Flag
curvepoint = PointOnCurve(flip.Curve, parameter=1)

midpt_2 = CurveMiddle(Curve=item_2)
dist = Distance(PointA=midpt, PointB=midpt_2)
division_2 = Division(A=dist, B=N)
bang = ExplodeTree(Data=flip.Curve)  # -> Branch0, Branch1, Branch2, Branch3
round = Round(Number=division_2)  # -> Nearest, Floor, Ceiling
division_3 = Division(A=dist, B=round.Nearest)
neg_2 = Negative(Value=division_3)
series = Series(Start=neg_2, Step=neg_2, Count=Slider(51, range=1..60))
offset_2 = OffsetCurve(Curve=item, Distance=series, Corners=1)
trim = TrimTree(Tree=offset_2, Depth=Slider(5, range=1..5))
trim_2 = TrimTree(Tree=offset, Depth=1)
trim_3 = TrimWithBrep(Curve=trim, Brep=trim_2)  # -> Inside, Outside
item_3 = ListItem(List=trim_3.Outside, Index=Slider(1, range=0..2), Wrap=True)
trim_4 = TrimTree(Tree=item_3, Depth=1)
bang_2 = ExplodeTree(Data=trim_4)  # -> Branch0, Branch1, Branch2, Branch3
merge_2 = Merge(Data1=g_inner_line_1_2, Data2=g_inner_line_2_2, Data3=g_inner_line_3_2)  # -> simplify(graft(Result))
merge_3 = Merge(Data1=e_inner_line_1_2, Data2=e_inner_line_2_2, Data3=e_inner_line_3_2)  # -> simplify(graft(Result))
merge_4 = Merge(Data1=f_inner_line_1_2, Data2=f_inner_line_2_2, Data3=f_inner_line_3_2)  # -> simplify(graft(Result))
merge_5 = Merge(Data1=d_inner_line_1_2, Data2=d_inner_line_2_2, Data3=d_inner_line_3_2)  # -> simplify(graft(Result))
series_2 = Series(Start=neg, Step=N, Count="3")
series_3 = Series(Start=neg, Step=N, Count="3")
series_4 = Series(Start=neg, Step=N, Count="3")
series_5 = Series(Start=neg, Step=N, Count="3")
offset_3 = OffsetCurve(Curve=merge_2, Distance=series_2, Corners=1)
offset_4 = OffsetCurve(Curve=merge_3, Distance=series_3, Corners=1)
offset_5 = OffsetCurve(Curve=merge_4, Distance=series_4, Corners=1)
offset_6 = OffsetCurve(Curve=merge_5, Distance=series_5, Corners=1)
trim_5 = TrimTree(Tree=offset_3, Depth=1)  # -> simplify(Tree)
trim_6 = TrimTree(Tree=offset_4, Depth=1)  # -> simplify(Tree)
trim_7 = TrimTree(Tree=offset_5, Depth=1)  # -> simplify(Tree)
trim_8 = TrimTree(Tree=offset_6, Depth=1)  # -> simplify(Tree)
bang_3 = ExplodeTree(Data=trim_5)  # -> Branch0, Branch1, Branch2
bang_4 = ExplodeTree(Data=trim_6)  # -> Branch0, Branch1, Branch2
bang_5 = ExplodeTree(Data=trim_7)  # -> Branch0, Branch1, Branch2
bang_6 = ExplodeTree(Data=trim_8)  # -> Branch0, Branch1, Branch2

# ----
# HORIZONTALES
offcrv = OffsetCurve(Curve=merge_2, Plane=PlaneXY(0, 0, 0), Distance=N, BothSides=neg, Kinks=0, CapType=1)  # -> simplify(Offset)
offcrv_2 = OffsetCurve(Curve=merge_5, Plane=PlaneXY(0, 0, 0), Distance=N, BothSides=neg, Kinks=0, CapType=1)  # -> simplify(Offset)
offcrv_3 = OffsetCurve(Curve=merge_3, Plane=PlaneXY(0, 0, 0), Distance=N, BothSides=neg, Kinks=0, CapType=1)  # -> simplify(Offset)
offcrv_4 = OffsetCurve(Curve=merge_4, Plane=PlaneXY(0, 0, 0), Distance=N, BothSides=neg, Kinks=0, CapType=1)  # -> simplify(Offset)
bang_7 = ExplodeTree(Data=offcrv)  # -> Branch0, Branch1, Branch2
bang_8 = ExplodeTree(Data=offcrv_2)  # -> Branch0, Branch1, Branch2
bang_9 = ExplodeTree(Data=offcrv_3)  # -> Branch0, Branch1, Branch2
bang_10 = ExplodeTree(Data=offcrv_4)  # -> Branch0, Branch1, Branch2
crv = Curve(bang_7.Branch0)
crv_2 = Curve(bang_7.Branch1)
crv_3 = Curve(bang_7.Branch2)
crv_4 = Curve(bang_8.Branch0)
crv_5 = Curve(bang_8.Branch1)
crv_6 = Curve(bang_8.Branch2)
crv_7 = Curve(bang_9.Branch0)
crv_8 = Curve(bang_9.Branch1)
crv_9 = Curve(bang_9.Branch2)
crv_10 = Curve(bang_10.Branch0)
crv_11 = Curve(bang_10.Branch1)
crv_12 = Curve(bang_10.Branch2)
boundary = BoundarySurfaces(Edges=crv)
boundary_2 = BoundarySurfaces(Edges=crv_2)
boundary_3 = BoundarySurfaces(Edges=crv_3)
boundary_4 = BoundarySurfaces(Edges=crv_4)
boundary_5 = BoundarySurfaces(Edges=crv_5)
boundary_6 = BoundarySurfaces(Edges=crv_6)
boundary_7 = BoundarySurfaces(Edges=crv_7)
boundary_8 = BoundarySurfaces(Edges=crv_8)
boundary_9 = BoundarySurfaces(Edges=crv_9)
boundary_10 = BoundarySurfaces(Edges=crv_10)
boundary_11 = BoundarySurfaces(Edges=crv_11)
boundary_12 = BoundarySurfaces(Edges=crv_12)
offsrf = OffsetSurface(Surface=boundary, Distance=N, BothSides=neg, CreateSolid=True)
offsrf_2 = OffsetSurface(Surface=boundary_2, Distance=N, BothSides=neg, CreateSolid=True)
offsrf_3 = OffsetSurface(Surface=boundary_3, Distance=N, BothSides=neg, CreateSolid=True)
offsrf_4 = OffsetSurface(Surface=boundary_4, Distance=N, BothSides=neg, CreateSolid=True)
offsrf_5 = OffsetSurface(Surface=boundary_5, Distance=N, BothSides=neg, CreateSolid=True)
offsrf_6 = OffsetSurface(Surface=boundary_6, Distance=N, BothSides=neg, CreateSolid=True)
offsrf_7 = OffsetSurface(Surface=boundary_7, Distance=N, BothSides=neg, CreateSolid=True)
offsrf_8 = OffsetSurface(Surface=boundary_8, Distance=N, BothSides=neg, CreateSolid=True)
offsrf_9 = OffsetSurface(Surface=boundary_9, Distance=N, BothSides=neg, CreateSolid=True)
offsrf_10 = OffsetSurface(Surface=boundary_10, Distance=N, BothSides=neg, CreateSolid=True)
offsrf_11 = OffsetSurface(Surface=boundary_11, Distance=N, BothSides=neg, CreateSolid=True)
offsrf_12 = OffsetSurface(Surface=boundary_12, Distance=N, BothSides=neg, CreateSolid=True)
trim_9 = TrimWithBrep(Curve=bang_2.Branch3, Brep=offsrf)  # -> Inside, simplify(Outside)
trim_10 = TrimWithBrep(Curve=bang_2.Branch0, Brep=offsrf_4)  # -> Inside, simplify(Outside)
trim_11 = TrimWithBrep(Curve=bang_2.Branch1, Brep=offsrf_7)  # -> Inside, simplify(Outside)
trim_12 = TrimWithBrep(Curve=bang_2.Branch2, Brep=offsrf_10)  # -> Inside, simplify(Outside)
crv_13 = Curve(trim_9.Outside)
crv_14 = Curve(trim_10.Outside)
crv_15 = Curve(trim_11.Outside)
crv_16 = Curve(trim_12.Outside)
trim_13 = TrimWithBrep(Curve=crv_13, Brep=offsrf_2)  # -> Inside, simplify(Outside)
trim_14 = TrimWithBrep(Curve=crv_14, Brep=offsrf_5)  # -> Inside, simplify(Outside)
trim_15 = TrimWithBrep(Curve=crv_15, Brep=offsrf_8)  # -> Inside, simplify(Outside)
trim_16 = TrimWithBrep(Curve=crv_16, Brep=offsrf_11)  # -> Inside, simplify(Outside)
crv_17 = Curve(trim_13.Outside)
crv_18 = Curve(trim_14.Outside)
crv_19 = Curve(trim_15.Outside)
crv_20 = Curve(trim_16.Outside)
trim_17 = TrimWithBrep(Curve=crv_17, Brep=offsrf_3)  # -> Inside, simplify(Outside)
trim_18 = TrimWithBrep(Curve=crv_18, Brep=offsrf_6)  # -> Inside, simplify(Outside)
trim_19 = TrimWithBrep(Curve=crv_19, Brep=offsrf_9)  # -> Inside, simplify(Outside)
trim_20 = TrimWithBrep(Curve=crv_20, Brep=offsrf_12)  # -> Inside, simplify(Outside)
crv_21 = Curve(trim_17.Outside)
crv_22 = Curve(trim_18.Outside)
crv_23 = Curve(trim_19.Outside)
crv_24 = Curve(trim_20.Outside)
ext = ExtendCurve(Curve=crv_21, Type=0, Start="-5", End="-5")
ext_2 = ExtendCurve(Curve=crv_22, Type=0, Start="-5", End="-5")
ext_3 = ExtendCurve(Curve=crv_23, Type=0, Start="-5", End="-5")
ext_4 = ExtendCurve(Curve=crv_24, Type=0, Start="-5", End="-5")
len = Length(Curve=ext)
len_2 = Length(Curve=ext_2)
len_3 = Length(Curve=ext_3)
len_4 = Length(Curve=ext_4)
larger = LargerThan(FirstNumber=len, SecondNumber="20")  # -> LargerThan, OrEqualTo
larger_2 = LargerThan(FirstNumber=len_2, SecondNumber="20")  # -> LargerThan, OrEqualTo
larger_3 = LargerThan(FirstNumber=len_3, SecondNumber="20")  # -> LargerThan, OrEqualTo
larger_4 = LargerThan(FirstNumber=len_4, SecondNumber="20")  # -> LargerThan, OrEqualTo
dispatch = Dispatch(List=ext, DispatchPattern=larger.LargerThan)  # -> ListA, ListB
dispatch_2 = Dispatch(List=ext_2, DispatchPattern=larger_2.LargerThan)  # -> ListA, ListB
dispatch_3 = Dispatch(List=ext_3, DispatchPattern=larger_3.LargerThan)  # -> ListA, ListB
dispatch_4 = Dispatch(List=ext_4, DispatchPattern=larger_4.LargerThan)  # -> ListA, ListB
crv_25 = Curve(dispatch.ListA)
crv_26 = Curve(dispatch_2.ListA)
crv_27 = Curve(dispatch_3.ListA)
crv_28 = Curve(dispatch_4.ListA)
trim_21 = TrimTree(Tree=crv_25, Depth=Slider(2, range=1..2))
trim_22 = TrimTree(Tree=crv_26, Depth=Slider(2, range=1..2))
trim_23 = TrimTree(Tree=crv_27, Depth=Slider(2, range=1..2))
trim_24 = TrimTree(Tree=crv_28, Depth=Slider(2, range=1..2))
l_branch = ListBranch(T=trim_21, i=Slider(51, range=0..51))
curvepoint_2 = PointOnCurve(l_branch, parameter=0)
l_branch_2 = ListBranch(T=trim_22, i=Slider(51, range=0..51))
l_branch_3 = ListBranch(T=trim_23, i=Slider(51, range=0..51))
l_branch_4 = ListBranch(T=trim_24, i=Slider(51, range=0..51))
curvepoint_3 = PointOnCurve(l_branch_2, parameter=0)
curvepoint_4 = PointOnCurve(l_branch_3, parameter=0)
curvepoint_5 = PointOnCurve(l_branch_4, parameter=0)
item_4 = ListItem(List=l_branch, Index=Slider(0, range=0..3), Wrap=True)
item_5 = ListItem(List=l_branch_2, Index=Slider(0, range=0..3), Wrap=True)
item_6 = ListItem(List=l_branch_3, Index=Slider(0, range=0..3), Wrap=True)
item_7 = ListItem(List=l_branch_4, Index=Slider(0, range=0..3), Wrap=True)

trim_25 = TrimWithBrep(Curve=bang_3.Branch0, Brep=offsrf_2)  # -> Inside, simplify(Outside)
trim_26 = TrimWithBrep(Curve=bang_4.Branch0, Brep=offsrf_8)  # -> Inside, simplify(Outside)
trim_27 = TrimWithBrep(Curve=bang_5.Branch0, Brep=offsrf_11)  # -> Inside, simplify(Outside)
trim_28 = TrimWithBrep(Curve=bang_6.Branch0, Brep=offsrf_5)  # -> Inside, simplify(Outside)
crv_29 = Curve(trim_25.Outside)
crv_30 = Curve(trim_26.Outside)
crv_31 = Curve(trim_27.Outside)
crv_32 = Curve(trim_28.Outside)
flatten = FlattenTree(Tree=crv_29, Path="{0}")
flatten_2 = FlattenTree(Tree=crv_30, Path="{0}")
flatten_3 = FlattenTree(Tree=crv_31, Path="{0}")
flatten_4 = FlattenTree(Tree=crv_32, Path="{0}")
stack = StackTrees(Data0=flatten, Data1=bang_3.Branch1, Data2=bang_3.Branch2, Reduce=True)
stack_2 = StackTrees(Data0=flatten_2, Data1=bang_4.Branch1, Data2=bang_4.Branch2, Reduce=True)
stack_3 = StackTrees(Data0=flatten_3, Data1=bang_5.Branch1, Data2=bang_5.Branch2, Reduce=True)
stack_4 = StackTrees(Data0=flatten_4, Data1=bang_6.Branch1, Data2=bang_6.Branch2, Reduce=True)
ext_5 = ExtendCurve(Curve=stack_4, Type=0, Start="-5", End="-5")
ext_6 = ExtendCurve(Curve=stack, Type=0, Start="-5", End="-5")
ext_7 = ExtendCurve(Curve=stack_2, Type=0, Start="-5", End="-5")
ext_8 = ExtendCurve(Curve=stack_3, Type=0, Start="-5", End="-5")
curvepoint_6 = PointOnCurve(ext_5, parameter=1)
d_contour = Curve(bang.Branch0)
e_contour = Curve(bang.Branch1)
f_contour = Curve(bang.Branch2)
g_contour = Curve(bang.Branch3)
T = ClusterOutput(trim_23)
T_2 = ClusterOutput(trim_24)
C = ClusterOutput(ext_7)
C_2 = ClusterOutput(ext_8)
T_3 = ClusterOutput(trim_22)
T_4 = ClusterOutput(trim_21)
C_3 = ClusterOutput(ext_5)
C_4 = ClusterOutput(ext_6)
d_contour_2 = ClusterOutput(d_contour)
e_contour_2 = ClusterOutput(e_contour)
g_contour_2 = ClusterOutput(g_contour)
f_contour_2 = ClusterOutput(f_contour)

# ==== cluster ListBranch: Select a specific branch from tree
T = ClusterInput()
i = ClusterInput()
T_2 = Data(T)
tstat = TreeStatistics(Tree=T_2)  # -> Paths, Length, Count
item = ListItem(List=tstat.Paths, Index=i, Wrap=True)
branch = TreeBranch(Tree=T_2, Path=item, MaintainPaths=True)
B = ClusterOutput(branch)

# ==== cluster SeamCreator: point = 0 curve = 1 plane = 2 brep = 3 mesh = 4
curve = ClusterInput()
start_reduction = ClusterInput()
gate = ClusterInput()
stream = ClusterInput()
end_reduction = ClusterInput()
clscrv = CloseCurve(Curve=curve, CloseType=0, Bulge=0.5, Tolerance=0)  # -> Closed, R
gate_2 = StreamGate(Stream=stream, Gate=gate)  # -> Target0, Target1, Target2, Target3, Target4
item = ListItem(List=clscrv.Closed, Index=0, Wrap=True)
pln = Plane(gate_2.Target2)
flip = FlipCurve(Curve=clscrv.Closed, Guide=item)  # -> Curve, Flag
pcx = CurvePlane(Curve=flip.Curve, Plane=pln)  # -> simplify(Points), ParamsC, ParamsP
crv = Curve(gate_2.Target1)
flip_2 = FlipMatrix(Data=pcx.Points)
mesh = Mesh(gate_2.Target4)
brep = Brep(gate_2.Target3)
crvprox = CurveProximity(CurveA=flip.Curve, CurveB=crv)  # -> PointA, PointB, Distance
bcx = BrepCurve(Brep=brep, Curve=flip.Curve)  # -> Curves, Points
mcx = MeshCurve(Mesh=mesh, Curve=flip.Curve)  # -> Points, Faces
branch = TreeBranch(Tree=flip_2, Path="{0}", MaintainPaths=True)
pt = Point(gate_2.Target0)
filter = StreamFilter(Gate=0, Stream0=pt, Stream1=crvprox.PointA, Stream2=branch, Stream3=bcx.Points, Stream4=mcx.Points)
crv_cp = CurveClosestPoint(Point=filter, Curve=flip.Curve)  # -> Point, Parameter, Distance
seam = Seam(Curve=flip.Curve, Seam=crv_cp.Parameter)
ext = ExtendCurve(Curve=seam, Type=0, StartReduction=start_reduction, EndReduction=end_reduction)
curve_2 = ClusterOutput(ext)
