# Grasshopper definition 03_TUFTING_ABB.gh (Grasshopper 1.0.8)
# plug-ins: Robots, treesloth01, Pufferfish

sonrisas = Curve(Tree({0}: [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], {1}: [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], {2}: [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], {3}: [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], {4}: [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], {5}: [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], {6}: [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], {7}: [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]))
curvas_horizontales_iguales = Curve(Tree({0}: [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], {1}: [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], {2}: [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], {3}: [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], {4}: [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], {5}: [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]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))
Y = UnitY(Factor="400")

# ---- group: CURVAS TUFTING
# CURVAS PARA TUFTING
# INTERNALIZAR DEL ARCHIVO
# 02_TUFTING_KUKA_GEOMETRY.GH
crv = Curve(Tree({0}: [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], {1}: [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], {2}: [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], {3}: [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], {4}: [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], {5}: [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], {6}: [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]))  # disabled

# ----
rotate = Rotate(Geometry=curvas_horizontales_iguales, Angle=degrees(Slider(-90, range=-90..0)), Plane=PlaneXY(0, 0, 0))  # -> Geometry, Transform
rotate_2 = Rotate(Geometry=sonrisas, Angle=degrees(Slider(-90, range=-90..0)), Plane=PlaneXY(0, 0, 0))  # -> Geometry, Transform
move = Move(Geometry=rotate.Geometry, Motion=Y)  # -> Geometry, Transform
tstat = TreeStatistics(Tree=rotate_2.Geometry)  # -> Paths, Length, Count
l_branch = ListBranch(T=rotate_2.Geometry, i="-1")
flip = FlipCurve(Curve=l_branch)  # -> Curve, Flag
cull_branch = CullBranch(T=rotate_2.Geometry, I="-1")
stack = StackTrees(Data0=cull_branch, Data1=flip.Curve, Reduce=True)
Y_2 = UnitY(Factor="400")
move_2 = Move(Geometry=stack, Motion=Y_2)  # -> Geometry, Transform
topoly = CurveToPolyline(Curve=stack, ToleranceDistance="0.02", ToleranceAngle=0, MinEdge="10", MaxEdge="20")  # -> Polyline, Segments
topoly_2 = CurveToPolyline(Curve=move.Geometry, ToleranceDistance=0, ToleranceAngle=0, MaxEdge="30")  # -> Polyline, Segments
cull_i = CullIndex(List=topoly.Polyline, Indices="1", Wrap=True)
pcol = PolylineCollapse(Polyline=topoly_2.Polyline, Tolerance="15")  # -> simplify(Polyline), Count
pcol_2 = PolylineCollapse(Polyline=topoly.Polyline, Tolerance="2")  # -> simplify(Polyline), Count

# ----
# LANA COLOR BLANCO
# 2000 mm/130 mm
# 
# ? mm/1000 mm
# 
# FACTOR = 2000/130 = 15,38 --> ROUNDED TO 15,5
len = Length(Curve=pcol_2.Polyline)
flatten = FlattenTree(Tree=len, Path="{0}")
ma = MassAddition(Input=flatten)  # -> Result, PartialResults
division = Division(A=ma.Result, B=1000)
roundd = RoundToDecimalPlace(NumberX=division, DecimalPlace="2", RoundType=0)  # -> Rounded, Difference
metros_lana_reales = Panel(roundd.Rounded)
multiplication = Multiplication(A=ma.Result, B="15.5")
division_2 = Division(A=multiplication, B=1000)
metros_bobina = Panel("1100")
division_3 = Division(A=division_2, B=metros_bobina)
roundd_2 = RoundToDecimalPlace(NumberX=division_2, DecimalPlace="2", RoundType=0)  # -> Rounded, Difference
round = Round(Number=division_3)  # -> Nearest, Floor, Ceiling
metros_lana_s_factor = Panel(roundd_2.Rounded)
bobinas = Panel(round.Ceiling)

# ----
# LANA COLOR MARRON
len_2 = Length(Curve=pcol.Polyline)
flatten_2 = FlattenTree(Tree=len_2, Path="{0}")
ma_2 = MassAddition(Input=flatten_2)  # -> Result, PartialResults
division_4 = Division(A=ma_2.Result, B=1000)
roundd_3 = RoundToDecimalPlace(NumberX=division_4, DecimalPlace="1", RoundType=0)  # -> Rounded, Difference
metros_lana_reales_2 = Panel(roundd_3.Rounded)
multiplication_2 = Multiplication(A=ma_2.Result, B="15.5")
division_5 = Division(A=multiplication_2, B=1000)
metros_bobina_2 = Panel("1100")
division_6 = Division(A=division_5, B=metros_bobina_2)
round_2 = Round(Number=division_6)  # -> Nearest, Floor, Ceiling
roundd_4 = RoundToDecimalPlace(NumberX=division_5, DecimalPlace="1", RoundType=0)  # -> Rounded, Difference
metros_lana_s_factor_2 = Panel(roundd_4.Rounded)
bobinas_2 = Panel(round_2.Ceiling)

# ---- group: Initial Position Izq
# POSICION ROBOT INICIO/FIN
number_slider = Slider(30, range=-130..130)
rad = Radians(Degrees=Slider(0, range=-300..300))
rad_2 = Radians(Degrees=number_slider)
rad_3 = Radians(Degrees=Slider(145, range=-65..145))
rad_4 = Radians(Degrees=Slider(0, range=-170..170))
rad_5 = Radians(Degrees=Slider(0, range=-300..300))
rad_6 = Radians(Degrees=Slider(-60, range=-180..70))
merge = Merge(Data1=rad_4, Data2=rad_3, Data3=rad_6, Data4=rad_5, Data5=rad_2, Data6=rad)
join = TextJoin(Text=merge, Join=",")

# ---- group: Altura peana
z = Panel("0")

# ----
# POSICION ROBOT
number_slider_2 = Slider(700, range=1..1000)
pt = ConstructPoint(XCoordinate=number_slider_2, YCoordinate=0, ZCoordinate=z)
xy = XYPlane(Origin=pt)
rad_7 = Radians(Degrees="0.62")
Z = UnitZ(Factor=1)
Y_3 = UnitY(Factor=1)
list = RobotsLibrary(
    {"LOW 6640", "LOWPOLY IRB6640", "TRAINING", "AA-KR60", "AA-KR30", "AA-KR60_KR30", "AARCH IRB120", "AARCH IRB6620", "Bigli-KR20", "UEL IRB6620", "uem-IRB120", "uem-IRB1600", "uem-IRB2600", "uem-IRB1600_IRB2600", "UniMelb-IRB120", "UniMelb-IRB1200", "UR3e", "UR5e", "UR10e", "UR16e", "UR3", "UR5", "UR10", "UR20", "UR30"}, selected="UniMelb-IRB1200",
    Type=0)
list_2 = RobotsLibrary(
    {"LOW 6640", "LOWPOLY IRB6640", "TRAINING", "AA-KR60", "AA-KR30", "AA-KR60_KR30", "AARCH IRB120", "AARCH IRB6620", "Bigli-KR20", "UEL IRB6620", "uem-IRB120", "uem-IRB1600", "uem-IRB2600", "uem-IRB1600_IRB2600", "UniMelb-IRB120", "UniMelb-IRB1200", "UR3e", "UR5e", "UR10e", "UR16e", "UR3", "UR5", "UR10", "UR20", "UR30"}, selected="Bigli-KR20",
    Type=0)
vrot = Rotate(Vector=Z, Axis=Y_3, Angle=rad_7)
padjust = AdjustPlane(Plane=xy, Normal=vrot)
load_robot = LoadRobotSystem(Name=list, Base=padjust)

# ---- group: Travel Speed
panel = Panel("100")
speed = SpeedParameter(panel)

# ----
Y_4 = UnitY(Factor=1)
X = UnitX(Factor=1)

canvas = Surface(<surface referenced from the Rhino model>)
canvas_girado = Surface(<surface referenced from the Rhino model>)  # disabled

jagged = SettingsSpeed()

# ---- group: nueva pistola
pistola_tufting = Brep(<brep referenced from the Rhino model>)

# ----
neg = Negative(Value=X)
mesh = MeshBrep(Brep=pistola_tufting, Settings=jagged)
mjoin = MeshJoin(Meshes=mesh)

# ---- group: Tool Geometry
# GEOMETIA PISTOLA TUFTING
ajuste_modelo_realidad = Panel("0")
separación_y_tcp = Panel("0")
separación_z_tcp = Panel("321.27")
altura_tcp = Panel("-16.51")
ajuste_modelo_realidad_2 = Panel("0")
addition = Addition(A=ajuste_modelo_realidad, B=separación_y_tcp)
addition_2 = Addition(A=ajuste_modelo_realidad_2, B=altura_tcp)
vec = VectorXYZ(XComponent=addition_2, YComponent=addition, ZComponent=separación_z_tcp)  # -> Vector, Length
pt_2 = Point(Point(0, 0, 0))
move_3 = Move(Geometry=pt_2, Motion=vec.Vector)  # -> Geometry, Transform
Z_2 = UnitZ(Factor=1)
pl = ConstructPlane(Origin=move_3.Geometry, XAxis=Z_2, YAxis=Y_4)
kg = Panel("0.5")
tool = CreateTool(Name="Tufting_gun", TCP=pl, Weight=kg, Mesh=mjoin)  # -> Tool, TCP

# ----
# ORIENTACION AL CANVAS
bbox = BoundingBox(Content=flatten(pcol_2.Polyline), Plane=PlaneXY(0, 0, 0), UnionBox=True)  # -> Box, Box_2
area = Area(Geometry=bbox.Box)  # -> Area, Centroid
pl_origin = PlaneOrigin(Base=bbox.Box, Origin=area.Centroid)
area_2 = Area(Geometry=canvas)  # -> Area, Centroid
orient = Orient(Geometry=pcol_2.Polyline, Source=pl_origin, Target=canvas)  # -> Geometry, Transform
rotacion_ya_en_canvas = Slider(0, range=0..360)
yz = YZPlane(Origin=area_2.Centroid)
rotate_3 = Rotate(Geometry=orient.Geometry, Angle=degrees(Slider(-90, range=-90..90)), Plane=yz)  # -> Geometry, Transform

# ----
# ORIENTACION AL CANVAS
bbox_2 = BoundingBox(Content=flatten(pcol.Polyline), Plane=PlaneXY(0, 0, 0), UnionBox=True)  # -> Box, Box_2
area_3 = Area(Geometry=bbox_2.Box)  # -> Area, Centroid
pl_origin_2 = PlaneOrigin(Base=bbox_2.Box, Origin=area_3.Centroid)
area_4 = Area(Geometry=canvas)  # -> Area, Centroid
orient_2 = Orient(Geometry=pcol.Polyline, Source=pl_origin_2, Target=canvas)  # -> Geometry, Transform
rotacion_ya_en_canvas_2 = Slider(0, range=0..360)
yz_2 = YZPlane(Origin=area_4.Centroid)
rotate_4 = Rotate(Geometry=orient_2.Geometry, Angle=degrees(Slider(-90, range=-90..90)), Plane=yz_2)  # -> Geometry, Transform

target = CreateTarget(Joints=join, Tool=tool.Tool, Speed=speed, IsCartesian=False)

# ----
# MESAJE/PARADA/ACCION SOLICITADA
panel_2 = Panel("""Cambie el Color de la Bobina y pulse PLAY
 para continuar""")  # disabled
stop = StopProgram()  # disabled
message = Message(Message=panel_2)  # disabled
merge_2 = Merge(Data1=message, Data2=stop)  # disabled
groupcmd = GroupCommand(Commands=merge_2)  # disabled

# ----
# ELEGIR S/KUKA
# PULSADOR NA
pin = Panel("8")
canal_real = Panel("-1")

# ----
# ELEGIR S/KUKA
# LUZ ROJA
pin_2 = Panel("2")
canal_real_2 = Panel("-1")

# ----
# On/Off Luz Verde
pin_3 = Panel("1")
canal_real_3 = Panel("-1")
addition_3 = Addition(A=pin_3, B=canal_real_3)
setdo = SetDO(DO=addition_3, Value=Toggle(True))
setdo_2 = SetDO(DO=addition_3, Value=Toggle(False))

# ----
# On/Off Luz Roja
addition_4 = Addition(A=pin_2, B=canal_real_2)
setdo_3 = SetDO(DO=addition_4, Value=Toggle(True))
setdo_4 = SetDO(DO=addition_4, Value=Toggle(False))

# ---- group: PULSADOR NA
# Pulsador Cambio Hilo Listo
addition_5 = Addition(A=pin, B=canal_real)
waitdi = WaitDI(DI=addition_5)

# ----
# ELEGIR S/KUKA
# PIN PISTOLA
# TUFTING
dotuft = Panel("3")

# ----
# Acomodar la posición
# para que no tenga
# singularidades ni giros
# bruscos
number_slider_3 = Slider(-10, range=-180..180)

# ----
# On/Off Luz Verde
pin_4 = Panel("1")
canal_real_4 = Panel("-1")
addition_6 = Addition(A=pin_4, B=canal_real_4)
setdo_5 = SetDO(DO=addition_6, Value=Toggle(True))
setdo_6 = SetDO(DO=addition_6, Value=Toggle(False))

# ----
# CAMBIO DE HILO
merge_3 = Merge(Data1=setdo_3, Data2=waitdi, Data3=setdo_4)
groupcmd_2 = GroupCommand(Commands=merge_3)

# ----
# PUNTO CAMBIO HILO
# (menos en la ultima)
pt_3 = Point(<point referenced from the Rhino model>)
xy_2 = XYPlane(Origin=pt_3)
rotate_plane = RotatePlane(Plane=xy_2, Angle=degrees(number_slider_3))
list_3 = ValueList({"Joint", "Linear"}, selected="Linear")
target_2 = CreateTarget(Plane=rotate_plane, Motion=list_3, Tool=tool.Tool, Speed=speed, Zone="10", Command=groupcmd_2, IsCartesian=True)

# ----
# ELEGIR S/KUKA
# PIN PISTOLA
# TUFTING
dotuft_2 = Panel("3")

panel_3 = Panel("50")
speed_2 = SpeedParameter(panel_3)

# ----
# On/Off Luz Amarilla
# Iniciando/Terminando?
pin_5 = Panel("0")  # disabled
canal_real_5 = Panel("-1")  # disabled
addition_7 = Addition(A=pin_5, B=canal_real_5)  # disabled
toggle = BooleanToggle(True)  # disabled
toggle_2 = BooleanToggle(False)  # disabled
setdo_7 = SetDO(DO=addition_7, Value=toggle)  # disabled
setdo_8 = SetDO(DO=addition_7, Value=toggle_2)  # disabled

pt_4 = Point(<point referenced from the Rhino model>)
wait_at_finish = Panel("1.1")
wait = Wait(Time=wait_at_finish)
# Right Click At the Component
# Add Command Input
merge_4 = Merge(Data1=setdo_7, Data2=waitdi, Data3=setdo_8)  # disabled
groupcmd_3 = GroupCommand(Commands=merge_4)  # disabled

# ----
# SIMULACION
simulacion = Slider(0.07581, range=0..1)

# ---- group: NOMBRE ARCHIVO
panel_4 = Panel("abb1")

# ----
# PRESS FOR SAVE
#        PROGRAM
button = Button()

velocidad = Panel("100")
division_7 = Division(A="100", B=velocidad)

# ----
# TARGETS DEL TOOLPATH PRINCIPAL
explode = Explode(Curve=rotate_4.Geometry, Recursive=True)  # -> Segments, Vertices
xy_3 = XYPlane(Origin=explode.Vertices)
end = EndPoints(Curve=explode.Segments)  # -> Start, End
vec2pt = Vector2Pt(PointA=end.Start, PointB=end.End, Unitize=False)  # -> Vector, Length
tolerance_between_targets = Panel("5")
tufting_mm_s = Panel("50")
_0_and_1_approach_distance = Panel("-100")
wait_at_finish_2 = Panel("0.5")
list_4 = ValueList({"Joint", "Linear"}, selected="Linear")
zone = ZoneParameter(tolerance_between_targets)
speed_3 = SpeedParameter(tufting_mm_s)
panel_5 = Panel("50")
setdo_9 = SetDO(DO=dotuft, Value=Toggle(False))
setdo_10 = SetDO(DO=dotuft, Value=Toggle(True))
X_2 = UnitX(Factor=_0_and_1_approach_distance)
tolerance_at_first_and_last_point = Panel("0")
merge_5 = Merge(Data1=setdo_10, Data2=setdo)
stop_2 = StopProgram()  # disabled
merge_6 = Merge(Data1=setdo_9, Data2=setdo_2)
list_5 = ValueList({"Joint", "Linear"}, selected="Linear")
wait_2 = Wait(Time=wait_at_finish_2)
speed_4 = SpeedParameter(panel_5)
groupcmd_4 = GroupCommand(Commands=merge_5)
groupcmd_5 = GroupCommand(Commands=merge_6)
zone_2 = ZoneParameter(tolerance_at_first_and_last_point)

item = ListItem(List=vec2pt.Vector, Index="-1", Wrap=True)
ins = InsertItems(List=vec2pt.Vector, Item=item, Indices="-1", Wrap=True)

# ----
# TARGETS DEL TOOLPATH PRINCIPAL
# SALIDA
# ENTRADA
explode_2 = Explode(Curve=rotate_3.Geometry, Recursive=True)  # -> Segments, Vertices
end_2 = EndPoints(Curve=explode_2.Segments)  # -> Start, End
vec2pt_2 = Vector2Pt(PointA=end_2.Start, PointB=end_2.End, Unitize=False)  # -> Vector, Length
xy_4 = XYPlane(Origin=explode_2.Vertices)
tolerance_between_targets_2 = Panel("5")
tufting_mm_s_2 = Panel("50")
_0_and_1_approach_distance_2 = Panel("-100")
wait_at_finish_3 = Panel("0.5")
list_6 = ValueList({"Joint", "Linear"}, selected="Linear")
zone_3 = ZoneParameter(tolerance_between_targets_2)
panel_6 = Panel("50")
speed_5 = SpeedParameter(tufting_mm_s_2)
setdo_11 = SetDO(DO=dotuft_2, Value=Toggle(False))
setdo_12 = SetDO(DO=dotuft_2, Value=Toggle(True))
X_3 = UnitX(Factor=_0_and_1_approach_distance_2)
tolerance_at_first_and_last_point_2 = Panel("0")
merge_7 = Merge(Data1=setdo_12, Data2=setdo_5)
stop_3 = StopProgram()  # disabled
merge_8 = Merge(Data1=setdo_11, Data2=setdo_6)
list_7 = ValueList({"Joint", "Linear"}, selected="Linear")
wait_3 = Wait(Time=wait_at_finish_3)
speed_6 = SpeedParameter(panel_6)
groupcmd_6 = GroupCommand(Commands=merge_7)
groupcmd_7 = GroupCommand(Commands=merge_8)
zone_4 = ZoneParameter(tolerance_at_first_and_last_point_2)

item_2 = ListItem(List=vec2pt_2.Vector, Index="-1", Wrap=True)
ins_2 = InsertItems(List=vec2pt_2.Vector, Item=item_2, Indices="-1", Wrap=True)

padjust_2 = AdjustPlane(Plane=xy_4, Normal=ins_2)
pshift = ShiftPaths(Data=padjust_2, Offset="-1")
target_3 = CreateTarget(Plane=padjust_2, Motion=list_6, Tool=tool.Tool, Speed=speed_5, Zone=zone_3, IsCartesian=True)
item_3 = ListItem(List=padjust_2, Index=0, Wrap=True)
item_4 = ListItem(List=padjust_2, Index="-1", Wrap=True)
move_4 = Move(Geometry=item_3, Motion=X_3)  # -> Geometry, Transform
move_5 = Move(Geometry=item_4, Motion=X_3)  # -> Geometry, Transform
item_5 = ListItem(List=target_3, Index="0", Wrap=True)
target_4 = CreateTarget(Target=item_5, Zone=zone_4, Command=groupcmd_6, IsCartesian=True)
replace = ReplaceItems(List=target_3, Item=target_4, Indices="0", Wrap=False)
target_5 = CreateTarget(Plane=move_4.Geometry, Motion=list_7, Tool=tool.Tool, Speed=speed_6, IsCartesian=True)
lng = ListLength(List=replace)  # -> expr("x-1", Length)
item_6 = ListItem(List=replace, Index="-1", Wrap=True)
target_6 = CreateTarget(Target=target_5, Plane=move_5.Geometry, Speed=speed_2, Command=wait_3, IsCartesian=True)
target_7 = CreateTarget(Target=item_6, Zone=zone_4, Command=groupcmd_7, IsCartesian=True)
replace_2 = ReplaceItems(List=replace, Item=target_7, Indices=lng, Wrap=False)
pshift_2 = ShiftPaths(Data=replace_2, Offset="-2")
merge_9 = Merge(Data1=target_5, Data2=pshift_2, Data3=target_6)

flatten_3 = FlattenTree(Tree=merge_9, Path="{0}")

# ----
# PUNTO PREVIO ENTRADA/SALIDA INICIO/FIN DEL TOTAL
pt_5 = Point(<point referenced from the Rhino model>)
yz_plane = YZPlane(Origin=pt_5)
list_8 = ValueList({"Joint", "Linear"}, selected="Linear")
xy_5 = XYPlane(Origin=pt_5)
target_8 = CreateTarget(Plane=xy_5, Motion=list_8, Tool=tool.Tool, Speed=speed, Zone="10", Command=wait_3, IsCartesian=True)

padjust_3 = AdjustPlane(Plane=xy_3, Normal=ins)
pshift_3 = ShiftPaths(Data=padjust_3, Offset="-1")
target_9 = CreateTarget(Plane=padjust_3, Motion=list_4, Tool=tool.Tool, Speed=speed_3, Zone=zone, IsCartesian=True)
item_7 = ListItem(List=padjust_3, Index=0, Wrap=True)
item_8 = ListItem(List=padjust_3, Index="-1", Wrap=True)
move_6 = Move(Geometry=item_7, Motion=X_2)  # -> Geometry, Transform
move_7 = Move(Geometry=item_8, Motion=X_2)  # -> Geometry, Transform
item_9 = ListItem(List=target_9, Index="0", Wrap=True)
target_10 = CreateTarget(Target=item_9, Zone=zone_2, Command=groupcmd_4, IsCartesian=True)
replace_3 = ReplaceItems(List=target_9, Item=target_10, Indices="0", Wrap=False)
lng_2 = ListLength(List=replace_3)  # -> expr("x-1", Length)
item_10 = ListItem(List=replace_3, Index="-1", Wrap=True)
target_11 = CreateTarget(Target=item_10, Zone=zone_2, Command=groupcmd_5, IsCartesian=True)
replace_4 = ReplaceItems(List=replace_3, Item=target_11, Indices=lng_2, Wrap=False)
pshift_4 = ShiftPaths(Data=replace_4, Offset="-2")

# ----
# SALIDA
# ENTRADA
target_12 = CreateTarget(Plane=move_6.Geometry, Motion=list_5, Tool=tool.Tool, Speed=speed_4, IsCartesian=True)
target_13 = CreateTarget(Target=target_12, Plane=move_7.Geometry, Speed=speed_4, Command=wait_2, IsCartesian=True)

merge_10 = Merge(Data1=target_12, Data2=pshift_4, Data3=target_13)

flatten_4 = FlattenTree(Tree=merge_10, Path="{0}")
merge_11 = Merge(Data1=target_8, Data2=flatten(merge_9), Data3=target_2, Data4=flatten(flatten_4), Data5=target_8)

# ----
# TOOLPATH GENERAL
merge_12 = Merge(Data1=merge_9, Data2=target_2, Data3=flatten_4)

# ----
# POSICION INICIAL/FINAL
merge_13 = Merge(Data1=target, Data2=merge_11, Data3=target)

create_program = CreateProgram(Name=panel_4, RobotSystem=load_robot, Targets=flatten(merge_13), StepSize=1)  # -> Program, Code, Duration, Warnings, Errors

gate = StreamGate(Stream=create_program.Program, Gate=button)  # -> Target0, Target1

# ---- group: Simulation
sim = ProgramSimulation(Program=create_program.Program, Time=simulacion, Normalized=True)  # -> SystemMeshes, JointRotations, Plane, Index, Time, Program, Errors
lng_3 = ListLength(List=sim.SystemMeshes)
trail = SimpleTrail(Program=sim.Program, Length="100000", MechanicalGroup=0)
subtraction = Subtraction(A=lng_3, B=1)
split = SplitList(List=sim.SystemMeshes, Index=subtraction)  # -> ListA, ListB
frgb = ColourRGBF(Alpha=1, Red="0.965", Green="0.471", Blue="0.157")
item_11 = ListItem(List=split.ListA, Index="-1", Wrap=True)
frgb_2 = ColourRGBF(Alpha=1, Red="0.5195", Green="0.5312", Blue="0.5391")
material = CreateMaterial(Diffuse=frgb, Specular=RGB(255, 255, 255), Emission=RGB(0, 0, 0), Transparency=0, Shine=0)
cull_i_2 = CullIndex(List=split.ListA, Indices="-1", Wrap=True)
material_2 = CreateMaterial(Diffuse=frgb_2, Specular=RGB(255, 255, 255), Emission=RGB(0, 0, 0), Transparency=0, Shine=0)
material_3 = CreateMaterial(
    Diffuse=ColourSwatch(SwatchColor=RGB(209, 79, 79)),
    Specular=RGB(255, 255, 255),
    Emission=ColourSwatch(SwatchColor=RGB(46, 18, 18)),
    Transparency=0,
    Shine=0)

# ----
panel_7 = Panel(sim.Index)
multiplication_3 = Multiplication(A=sim.Time, B=division_7)
panel_8 = Panel(create_program.Errors)
panel_9 = Panel(create_program.Warnings)
cluster = Cluster(t=sim.Time)
cluster_2 = Cluster(t=multiplication_3)
division_8 = Division(A=create_program.Duration, B="3600")
saveprog = SaveProgram(Program=gate.Target1, Folder="D:\ROBOT_PROG\1200_TUFTING\EUPROJ\ABB")
duracion = Panel(cluster)
duracion_2 = Panel(cluster_2)
duracion_horas = Panel(division_8)

# ----
# ROBOT SIMULACION
preview = CustomPreview(Geometry=cull_i_2, Material=material)
preview_2 = CustomPreview(Geometry=item_11, Material=material_2)
preview_3 = CustomPreview(Geometry=split.ListB, Material=material_3)

panel_10 = Panel(create_program.Code)

# ==== cluster Cluster
t = ClusterInput()  # Time (seconds)
integer_division = IntegerDivision(A=t, B="60")
integer_division_2 = IntegerDivision(A=integer_division, B="60")
multiplication = Multiplication(A=integer_division, B="60")
multiplication_2 = Multiplication(A=integer_division_2, B="60")
subtraction = Subtraction(A=t, B=multiplication)
subtraction_2 = Subtraction(A=integer_division, B=multiplication_2)
integer_division_3 = IntegerDivision(A=subtraction, B="1")
concat = Concatenate(FragmentA=subtraction_2, FragmentB=" min ")
concat_2 = Concatenate(FragmentA=integer_division_2, FragmentB="h ")
concat_3 = Concatenate(FragmentA=integer_division_3, FragmentB=" seg")
concat_4 = Concatenate(FragmentC=concat_2, FragmentA=concat, FragmentB=concat_3)
duration = ClusterOutput(concat_4)

# ==== cluster CullBranch
T = ClusterInput()
I = ClusterInput()
T_2 = Data(T)
tstat = TreeStatistics(Tree=T_2)  # -> Paths, Length, Count
cull_i = CullIndex(List=tstat.Paths, Indices=I, Wrap=True)
branch = TreeBranch(Tree=T_2, Path=cull_i, MaintainPaths=True)
B = ClusterOutput(branch)

# ==== cluster ListBranch: Select a specific branch from tree
T = ClusterInput()
i = ClusterInput()
T_2 = Data(T)
tstat = TreeStatistics(Tree=T_2)  # -> Paths, Length, Count
item = ListItem(List=tstat.Paths, Index=i, Wrap=True)
branch = TreeBranch(Tree=T_2, Path=item, MaintainPaths=True)
B = ClusterOutput(branch)
