# Grasshopper definition 04_TUFTING ABB_MULTIFRAME.gh (Grasshopper 1.0.8)
# plug-ins: Robots, treesloth01, Pufferfish, Human

sonrisas = Curve(Tree({0}: [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], {1}: [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], {2}: [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], {3}: [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], {4}: [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], {5}: [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], {6}: [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], {7}: [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]))
curvas_horizontales_iguales = Curve(Tree({0}: [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], {1}: [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], {2}: [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], {3}: [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], {4}: [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], {5}: [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]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))
Y = UnitY(Factor="400")

# ---- group: CURVAS TUFTING
# CURVAS PARA TUFTING
# INTERNALIZAR DEL ARCHIVO
# 02_TUFTING_KUKA_GEOMETRY.GH
crv = Curve(Tree({0}: [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], {1}: [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], {2}: [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], {3}: [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], {4}: [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], {5}: [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], {6}: [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]))  # disabled

# ----
rotate = Rotate(Geometry=curvas_horizontales_iguales, Angle=degrees(Slider(-90, range=-90..0)), Plane=PlaneXY(0, 0, 0))  # -> Geometry, Transform
rotate_2 = Rotate(Geometry=sonrisas, Angle=degrees(Slider(-90, range=-90..0)), Plane=PlaneXY(0, 0, 0))  # -> Geometry, Transform
move = Move(Geometry=rotate.Geometry, Motion=Y)  # -> Geometry, Transform
tstat = TreeStatistics(Tree=rotate_2.Geometry)  # -> Paths, Length, Count
l_branch = ListBranch(T=rotate_2.Geometry, i="-1")
flip = FlipCurve(Curve=l_branch)  # -> Curve, Flag
cull_branch = CullBranch(T=rotate_2.Geometry, I="-1")
stack = StackTrees(Data0=cull_branch, Data1=flip.Curve, Reduce=True)
Y_2 = UnitY(Factor="400")
move_2 = Move(Geometry=stack, Motion=Y_2)  # -> Geometry, Transform
topoly = CurveToPolyline(Curve=stack, ToleranceDistance="0.02", ToleranceAngle=0, MinEdge="10", MaxEdge="20")  # -> Polyline, Segments
topoly_2 = CurveToPolyline(Curve=move.Geometry, ToleranceDistance=0, ToleranceAngle=0, MaxEdge="30")  # -> Polyline, Segments
pcol = PolylineCollapse(Polyline=topoly_2.Polyline, Tolerance="15")  # -> simplify(Polyline), Count
cull_i = CullIndex(List=topoly.Polyline, Indices="1", Wrap=True)
pcol_2 = PolylineCollapse(Polyline=cull_i, Tolerance="2")  # -> simplify(Polyline), Count

# ----
# LANA COLOR BLANCO
# 2000 mm/130 mm
# 
# ? mm/1000 mm
# 
# FACTOR = 2000/130 = 15,38 --> ROUNDED TO 15,5
len = Length(Curve=pcol_2.Polyline)
flatten = FlattenTree(Tree=len, Path="{0}")
ma = MassAddition(Input=flatten)  # -> Result, PartialResults
division = Division(A=ma.Result, B=1000)
roundd = RoundToDecimalPlace(NumberX=division, DecimalPlace="2", RoundType=0)  # -> Rounded, Difference
metros_lana_reales = Panel(roundd.Rounded)
multiplication = Multiplication(A=ma.Result, B="15.5")
division_2 = Division(A=multiplication, B=1000)
metros_bobina = Panel("1100")
division_3 = Division(A=division_2, B=metros_bobina)
roundd_2 = RoundToDecimalPlace(NumberX=division_2, DecimalPlace="2", RoundType=0)  # -> Rounded, Difference
round = Round(Number=division_3)  # -> Nearest, Floor, Ceiling
metros_lana_s_factor = Panel(roundd_2.Rounded)
bobinas = Panel(round.Ceiling)

# ----
# LANA COLOR MARRON
len_2 = Length(Curve=pcol.Polyline)
flatten_2 = FlattenTree(Tree=len_2, Path="{0}")
ma_2 = MassAddition(Input=flatten_2)  # -> Result, PartialResults
division_4 = Division(A=ma_2.Result, B=1000)
roundd_3 = RoundToDecimalPlace(NumberX=division_4, DecimalPlace="1", RoundType=0)  # -> Rounded, Difference
metros_lana_reales_2 = Panel(roundd_3.Rounded)
multiplication_2 = Multiplication(A=ma_2.Result, B="15.5")
division_5 = Division(A=multiplication_2, B=1000)
metros_bobina_2 = Panel("1100")
division_6 = Division(A=division_5, B=metros_bobina_2)
round_2 = Round(Number=division_6)  # -> Nearest, Floor, Ceiling
roundd_4 = RoundToDecimalPlace(NumberX=division_5, DecimalPlace="1", RoundType=0)  # -> Rounded, Difference
metros_lana_s_factor_2 = Panel(roundd_4.Rounded)
bobinas_2 = Panel(round_2.Ceiling)

sonrisas_2 = Curve(Tree({0}: [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], {1}: [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], {2}: [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], {3}: [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], {4}: [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], {5}: [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], {6}: [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], {7}: [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]))
curvas_horizontales_iguales_2 = Curve(Tree({0}: [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], {1}: [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], {2}: [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], {3}: [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], {4}: [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], {5}: [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]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))

# ---- group: CURVAS TUFTING
# CURVAS PARA TUFTING
# INTERNALIZAR DEL ARCHIVO
# 02_TUFTING_KUKA_GEOMETRY.GH
crv_2 = Curve(Tree({0}: [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], {1}: [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], {2}: [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], {3}: [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], {4}: [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], {5}: [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], {6}: [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]))  # disabled

# ----
rotate_3 = Rotate(Geometry=curvas_horizontales_iguales_2, Angle=degrees(Slider(-90, range=-90..0)), Plane=PlaneXY(0, 0, 0))  # -> Geometry, Transform
Y_3 = UnitY(Factor="400")
rotate_4 = Rotate(Geometry=sonrisas_2, Angle=degrees(Slider(-90, range=-90..0)), Plane=PlaneXY(0, 0, 0))  # -> Geometry, Transform
move_3 = Move(Geometry=rotate_3.Geometry, Motion=Y_3)  # -> Geometry, Transform
tstat_2 = TreeStatistics(Tree=rotate_4.Geometry)  # -> Paths, Length, Count
l_branch_2 = ListBranch(T=rotate_4.Geometry, i="-1")
flip_2 = FlipCurve(Curve=l_branch_2)  # -> Curve, Flag
cull_branch_2 = CullBranch(T=rotate_4.Geometry, I="-1")
stack_2 = StackTrees(Data0=cull_branch_2, Data1=flip_2.Curve, Reduce=True)
Y_4 = UnitY(Factor="400")

# ---- group: Initial Position Izq
# POSICION ROBOT INICIO/FIN
number_slider = Slider(30, range=-130..130)
rad = Radians(Degrees=Slider(0, range=-300..300))
rad_2 = Radians(Degrees=number_slider)
rad_3 = Radians(Degrees=Slider(145, range=-65..145))
rad_4 = Radians(Degrees=Slider(0, range=-170..170))
rad_5 = Radians(Degrees=Slider(0, range=-300..300))
rad_6 = Radians(Degrees=Slider(-60, range=-180..70))
merge = Merge(Data1=rad_4, Data2=rad_3, Data3=rad_6, Data4=rad_5, Data5=rad_2, Data6=rad)
join = TextJoin(Text=merge, Join=",")

# ----
move_4 = Move(Geometry=stack_2, Motion=Y_4)  # -> Geometry, Transform
number_slider_2 = Slider(0.93, range=0..1)

# ---- group: Altura peana
z = Panel("0")

# ----
# POSICION ROBOT
number_slider_3 = Slider(700, range=1..1000)
pt = ConstructPoint(XCoordinate=number_slider_3, YCoordinate=0, ZCoordinate=z)
xy = XYPlane(Origin=pt)
rad_7 = Radians(Degrees="0.62")
Z = UnitZ(Factor=1)
Y_5 = UnitY(Factor=1)
list = RobotsLibrary(
    {"LOW 6640", "LOWPOLY IRB6640", "TRAINING", "AA-KR60", "AA-KR30", "AA-KR60_KR30", "AARCH IRB120", "AARCH IRB6620", "Bigli-KR20", "UEL IRB6620", "uem-IRB120", "uem-IRB1600", "uem-IRB2600", "uem-IRB1600_IRB2600", "UniMelb-IRB120", "UniMelb-IRB1200", "UR3e", "UR5e", "UR10e", "UR16e", "UR3", "UR5", "UR10", "UR20", "UR30"}, selected="UniMelb-IRB1200",
    Type=0)
list_2 = RobotsLibrary(
    {"LOW 6640", "LOWPOLY IRB6640", "TRAINING", "AA-KR60", "AA-KR30", "AA-KR60_KR30", "AARCH IRB120", "AARCH IRB6620", "Bigli-KR20", "UEL IRB6620", "uem-IRB120", "uem-IRB1600", "uem-IRB2600", "uem-IRB1600_IRB2600", "UniMelb-IRB120", "UniMelb-IRB1200", "UR3e", "UR5e", "UR10e", "UR16e", "UR3", "UR5", "UR10", "UR20", "UR30"}, selected="Bigli-KR20",
    Type=0)
vrot = Rotate(Vector=Z, Axis=Y_5, Angle=rad_7)
padjust = AdjustPlane(Plane=xy, Normal=vrot)
load_robot = LoadRobotSystem(Name=list, Base=padjust)

# ---- group: Travel Speed
panel = Panel("100")
speed = SpeedParameter(panel)

# ----
Y_6 = UnitY(Factor=1)
X = UnitX(Factor=1)

canvas = Surface(<surface referenced from the Rhino model>)
canvas_girado = Surface(<surface referenced from the Rhino model>)  # disabled

jagged = SettingsSpeed()

# ---- group: nueva pistola
pistola_tufting = Brep(<brep referenced from the Rhino model>)

# ----
neg = Negative(Value=X)
mesh = MeshBrep(Brep=pistola_tufting, Settings=jagged)
topoly_3 = CurveToPolyline(Curve=stack_2, ToleranceDistance="0.02", ToleranceAngle=0, MinEdge="10", MaxEdge="20")  # -> Polyline, Segments
topoly_4 = CurveToPolyline(Curve=move_3.Geometry, ToleranceDistance=0, ToleranceAngle=0, MaxEdge="30")  # -> Polyline, Segments
mjoin = MeshJoin(Meshes=mesh)

# ---- group: Tool Geometry
# GEOMETIA PISTOLA TUFTING
ajuste_modelo_realidad = Panel("0")
separación_y_tcp = Panel("0")
separación_z_tcp = Panel("321.27")
altura_tcp = Panel("-16.51")
ajuste_modelo_realidad_2 = Panel("0")
addition = Addition(A=ajuste_modelo_realidad, B=separación_y_tcp)
addition_2 = Addition(A=ajuste_modelo_realidad_2, B=altura_tcp)
vec = VectorXYZ(XComponent=addition_2, YComponent=addition, ZComponent=separación_z_tcp)  # -> Vector, Length
pt_2 = Point(Point(0, 0, 0))
move_5 = Move(Geometry=pt_2, Motion=vec.Vector)  # -> Geometry, Transform
Z_2 = UnitZ(Factor=1)
pl = ConstructPlane(Origin=move_5.Geometry, XAxis=Z_2, YAxis=Y_6)
kg = Panel("0.5")
tool = CreateTool(Name="Tufting_gun", TCP=pl, Weight=kg, Mesh=mjoin)  # -> Tool, TCP

# ----
pcol_3 = PolylineCollapse(Polyline=topoly_4.Polyline, Tolerance="15")  # -> simplify(Polyline), Count
cull_i_2 = CullIndex(List=topoly_3.Polyline, Indices="1", Wrap=True)
pcol_4 = PolylineCollapse(Polyline=cull_i_2, Tolerance="2")  # -> simplify(Polyline), Count

# ----
# LANA COLOR BLANCO
# 2000 mm/130 mm
# 
# ? mm/1000 mm
# 
# FACTOR = 2000/130 = 15,38 --> ROUNDED TO 15,5
len_3 = Length(Curve=pcol_4.Polyline)
flatten_3 = FlattenTree(Tree=len_3, Path="{0}")
ma_3 = MassAddition(Input=flatten_3)  # -> Result, PartialResults
division_7 = Division(A=ma_3.Result, B=1000)
roundd_5 = RoundToDecimalPlace(NumberX=division_7, DecimalPlace="2", RoundType=0)  # -> Rounded, Difference
metros_lana_reales_3 = Panel(roundd_5.Rounded)
multiplication_3 = Multiplication(A=ma_3.Result, B="15.5")
division_8 = Division(A=multiplication_3, B=1000)
metros_bobina_3 = Panel("1100")
division_9 = Division(A=division_8, B=metros_bobina_3)
roundd_6 = RoundToDecimalPlace(NumberX=division_8, DecimalPlace="2", RoundType=0)  # -> Rounded, Difference
round_3 = Round(Number=division_9)  # -> Nearest, Floor, Ceiling
metros_lana_s_factor_3 = Panel(roundd_6.Rounded)
bobinas_3 = Panel(round_3.Ceiling)

# ----
# LANA COLOR MARRON
len_4 = Length(Curve=pcol_3.Polyline)
flatten_4 = FlattenTree(Tree=len_4, Path="{0}")
ma_4 = MassAddition(Input=flatten_4)  # -> Result, PartialResults
division_10 = Division(A=ma_4.Result, B=1000)
roundd_7 = RoundToDecimalPlace(NumberX=division_10, DecimalPlace="1", RoundType=0)  # -> Rounded, Difference
metros_lana_reales_4 = Panel(roundd_7.Rounded)
multiplication_4 = Multiplication(A=ma_4.Result, B="15.5")
division_11 = Division(A=multiplication_4, B=1000)
metros_bobina_4 = Panel("1100")
division_12 = Division(A=division_11, B=metros_bobina_4)
round_4 = Round(Number=division_12)  # -> Nearest, Floor, Ceiling
roundd_8 = RoundToDecimalPlace(NumberX=division_11, DecimalPlace="1", RoundType=0)  # -> Rounded, Difference
metros_lana_s_factor_4 = Panel(roundd_8.Rounded)
bobinas_4 = Panel(round_4.Ceiling)

target = CreateTarget(Joints=join, Tool=tool.Tool, Speed=speed, IsCartesian=False)

# ----
# MESAJE/PARADA/ACCION SOLICITADA
panel_2 = Panel("""Cambie el Color de la Bobina y pulse PLAY
 para continuar""")  # disabled
stop = StopProgram()  # disabled
message = Message(Message=panel_2)  # disabled
merge_2 = Merge(Data1=message, Data2=stop)  # disabled
groupcmd = GroupCommand(Commands=merge_2)  # disabled

# ----
# ELEGIR S/KUKA
# PULSADOR NA
pin = Panel("8")
canal_real = Panel("-1")

# ----
# ELEGIR S/KUKA
# LUZ ROJA
pin_2 = Panel("2")
canal_real_2 = Panel("-1")

# ----
# On/Off Luz Verde
pin_3 = Panel("1")
canal_real_3 = Panel("-1")
addition_3 = Addition(A=pin_3, B=canal_real_3)
setdo = SetDO(DO=addition_3, Value=Toggle(True))
setdo_2 = SetDO(DO=addition_3, Value=Toggle(False))

# ----
# On/Off Luz Roja
addition_4 = Addition(A=pin_2, B=canal_real_2)
setdo_3 = SetDO(DO=addition_4, Value=Toggle(True))
setdo_4 = SetDO(DO=addition_4, Value=Toggle(False))

# ---- group: PULSADOR NA
# Pulsador Cambio Hilo Listo
addition_5 = Addition(A=pin, B=canal_real)
waitdi = WaitDI(DI=addition_5)

# ----
# ELEGIR S/KUKA
# PIN PISTOLA
# TUFTING
dotuft = Panel("3")

# ----
# Acomodar la posición
# para que no tenga
# singularidades ni giros
# bruscos
number_slider_4 = Slider(-10, range=-180..180)

# ----
# On/Off Luz Verde
pin_4 = Panel("1")
canal_real_4 = Panel("-1")
addition_6 = Addition(A=pin_4, B=canal_real_4)
setdo_5 = SetDO(DO=addition_6, Value=Toggle(True))
setdo_6 = SetDO(DO=addition_6, Value=Toggle(False))

# ----
# CAMBIO DE HILO
merge_3 = Merge(Data1=setdo_3, Data2=waitdi, Data3=setdo_4)
groupcmd_2 = GroupCommand(Commands=merge_3)

# ----
# PUNTO CAMBIO HILO
# (menos en la ultima)
pt_3 = Point(<point referenced from the Rhino model>)
xy_2 = XYPlane(Origin=pt_3)
rotate_plane = RotatePlane(Plane=xy_2, Angle=degrees(number_slider_4))
list_3 = ValueList({"Joint", "Linear"}, selected="Linear")
target_2 = CreateTarget(Plane=rotate_plane, Motion=list_3, Tool=tool.Tool, Speed=speed, Zone="10", Command=groupcmd_2, IsCartesian=True)

# ----
# ELEGIR S/KUKA
# PIN PISTOLA
# TUFTING
dotuft_2 = Panel("3")

# ---- group: Initial Position Izq
# POSICION ROBOT INICIO/FIN
number_slider_5 = Slider(30, range=-130..130)
rad_8 = Radians(Degrees=Slider(0, range=-300..300))
rad_9 = Radians(Degrees=number_slider_5)
rad_10 = Radians(Degrees=Slider(145, range=-65..145))
rad_11 = Radians(Degrees=Slider(0, range=-170..170))
rad_12 = Radians(Degrees=Slider(0, range=-300..300))
rad_13 = Radians(Degrees=Slider(-60, range=-180..70))
merge_4 = Merge(Data1=rad_11, Data2=rad_10, Data3=rad_13, Data4=rad_12, Data5=rad_9, Data6=rad_8)
join_2 = TextJoin(Text=merge_4, Join=",")

# ----
number_slider_6 = Slider(0.93, range=0..1)

canvas_2 = Surface(<surface referenced from the Rhino model>)
canvas_girado_2 = Surface(<surface referenced from the Rhino model>)  # disabled

# ---- group: Altura peana
z_2 = Panel("0")

# ----
# POSICION ROBOT
number_slider_7 = Slider(700, range=1..1000)
pt_4 = ConstructPoint(XCoordinate=number_slider_7, YCoordinate=0, ZCoordinate=z_2)
xy_3 = XYPlane(Origin=pt_4)
rad_14 = Radians(Degrees="0.62")
Z_3 = UnitZ(Factor=1)
Y_7 = UnitY(Factor=1)
list_4 = RobotsLibrary(
    {"LOW 6640", "LOWPOLY IRB6640", "TRAINING", "AA-KR60", "AA-KR30", "AA-KR60_KR30", "AARCH IRB120", "AARCH IRB6620", "Bigli-KR20", "UEL IRB6620", "uem-IRB120", "uem-IRB1600", "uem-IRB2600", "uem-IRB1600_IRB2600", "UniMelb-IRB120", "UniMelb-IRB1200", "UR3e", "UR5e", "UR10e", "UR16e", "UR3", "UR5", "UR10", "UR20", "UR30"}, selected="UniMelb-IRB1200",
    Type=0)
list_5 = RobotsLibrary(
    {"LOW 6640", "LOWPOLY IRB6640", "TRAINING", "AA-KR60", "AA-KR30", "AA-KR60_KR30", "AARCH IRB120", "AARCH IRB6620", "Bigli-KR20", "UEL IRB6620", "uem-IRB120", "uem-IRB1600", "uem-IRB2600", "uem-IRB1600_IRB2600", "UniMelb-IRB120", "UniMelb-IRB1200", "UR3e", "UR5e", "UR10e", "UR16e", "UR3", "UR5", "UR10", "UR20", "UR30"}, selected="Bigli-KR20",
    Type=0)
vrot_2 = Rotate(Vector=Z_3, Axis=Y_7, Angle=rad_14)
padjust_2 = AdjustPlane(Plane=xy_3, Normal=vrot_2)
load_robot_2 = LoadRobotSystem(Name=list_4, Base=padjust_2)

canvas_3 = Surface(<surface referenced from the Rhino model>)

# ---- group: Travel Speed
panel_3 = Panel("100")
speed_2 = SpeedParameter(panel_3)

# ----
Y_8 = UnitY(Factor=1)
X_2 = UnitX(Factor=1)
jagged_2 = SettingsSpeed()
planar = IsPlanar(Surface=canvas_3, Interior=True)  # -> Planar, Plane
planar_2 = IsPlanar(Surface=canvas_2, Interior=True)  # -> Planar, Plane

# ---- group: nueva pistola
pistola_tufting_2 = Brep(<brep referenced from the Rhino model>)

# ----
neg_2 = Negative(Value=X_2)
panel_4 = Panel("50")
pflip = FlipPlane(Plane=planar_2.Plane, ReverseX=False, ReverseY=False, SwapAxes=True)
mesh_2 = MeshBrep(Brep=pistola_tufting_2, Settings=jagged_2)
pflip_2 = FlipPlane(Plane=planar.Plane, ReverseX=False, ReverseY=False, SwapAxes=True)
mjoin_2 = MeshJoin(Meshes=mesh_2)

# ---- group: Tool Geometry
# GEOMETIA PISTOLA TUFTING
ajuste_modelo_realidad_3 = Panel("0")
separación_y_tcp_2 = Panel("0")
separación_z_tcp_2 = Panel("321.27")
altura_tcp_2 = Panel("-16.51")
ajuste_modelo_realidad_4 = Panel("0")
addition_7 = Addition(A=ajuste_modelo_realidad_3, B=separación_y_tcp_2)
addition_8 = Addition(A=ajuste_modelo_realidad_4, B=altura_tcp_2)
vec_2 = VectorXYZ(XComponent=addition_8, YComponent=addition_7, ZComponent=separación_z_tcp_2)  # -> Vector, Length
pt_5 = Point(Point(0, 0, 0))
move_6 = Move(Geometry=pt_5, Motion=vec_2.Vector)  # -> Geometry, Transform
Z_4 = UnitZ(Factor=1)
pl_2 = ConstructPlane(Origin=move_6.Geometry, XAxis=Z_4, YAxis=Y_8)
kg_2 = Panel("0.5")
tool_2 = CreateTool(Name="Tufting_gun", TCP=pl_2, Weight=kg_2, Mesh=mjoin_2)  # -> Tool, TCP

# ----
speed_3 = SpeedParameter(panel_4)
target_3 = CreateTarget(Joints=join_2, Tool=tool_2.Tool, Speed=speed_2, IsCartesian=False)
series = Series(Start=0, Step=1, Count="6")
series_2 = Series(Start="6", Step=1, Count="2")
series_3 = Series(Start=0, Step=1, Count="6")
series_4 = Series(Start="6", Step=1, Count="2")
shader = Shader(ColourSwatch(SwatchColor=RGB(255, 255, 255)))
shader_2 = Shader(ColourSwatch(SwatchColor=RGB(112, 94, 94)))

# ----
# MESAJE/PARADA/ACCION SOLICITADA
panel_5 = Panel("""Cambie el Color de la Bobina y pulse PLAY
 para continuar""")  # disabled
stop_2 = StopProgram()  # disabled
message_2 = Message(Message=panel_5)  # disabled
merge_5 = Merge(Data1=message_2, Data2=stop_2)  # disabled
groupcmd_3 = GroupCommand(Commands=merge_5)  # disabled

# ----
# ELEGIR S/KUKA
# PULSADOR NA
pin_5 = Panel("8")
canal_real_5 = Panel("-1")

# ----
# ELEGIR S/KUKA
# LUZ ROJA
pin_6 = Panel("2")
canal_real_6 = Panel("-1")

# ----
# On/Off Luz Verde
pin_7 = Panel("1")
canal_real_7 = Panel("-1")
addition_9 = Addition(A=pin_7, B=canal_real_7)
setdo_7 = SetDO(DO=addition_9, Value=Toggle(True))
setdo_8 = SetDO(DO=addition_9, Value=Toggle(False))

# ----
# On/Off Luz Roja
addition_10 = Addition(A=pin_6, B=canal_real_6)
setdo_9 = SetDO(DO=addition_10, Value=Toggle(True))
setdo_10 = SetDO(DO=addition_10, Value=Toggle(False))

# ---- group: PULSADOR NA
# Pulsador Cambio Hilo Listo
addition_11 = Addition(A=pin_5, B=canal_real_5)
waitdi_2 = WaitDI(DI=addition_11)

# ----
# ELEGIR S/KUKA
# PIN PISTOLA
# TUFTING
dotuft_3 = Panel("3")

# ----
# Acomodar la posición
# para que no tenga
# singularidades ni giros
# bruscos
number_slider_8 = Slider(-10, range=-180..180)

# ----
# On/Off Luz Verde
pin_8 = Panel("1")
canal_real_8 = Panel("-1")
addition_12 = Addition(A=pin_8, B=canal_real_8)
setdo_11 = SetDO(DO=addition_12, Value=Toggle(True))
setdo_12 = SetDO(DO=addition_12, Value=Toggle(False))

# ----
# CAMBIO DE HILO
merge_6 = Merge(Data1=setdo_9, Data2=waitdi_2, Data3=setdo_10)
groupcmd_4 = GroupCommand(Commands=merge_6)

# ----
# PUNTO CAMBIO HILO
# (menos en la ultima)
pt_6 = Point(<point referenced from the Rhino model>)
xy_4 = XYPlane(Origin=pt_6)
rotate_plane_2 = RotatePlane(Plane=xy_4, Angle=degrees(number_slider_8))
list_6 = ValueList({"Joint", "Linear"}, selected="Linear")
target_4 = CreateTarget(Plane=rotate_plane_2, Motion=list_6, Tool=tool_2.Tool, Speed=speed_2, Zone="10", Command=groupcmd_4, IsCartesian=True)

# ----
# ELEGIR S/KUKA
# PIN PISTOLA
# TUFTING
dotuft_4 = Panel("3")

# ----
# On/Off Luz Amarilla
# Iniciando/Terminando?
pin_9 = Panel("0")  # disabled
canal_real_9 = Panel("-1")  # disabled
addition_13 = Addition(A=pin_9, B=canal_real_9)  # disabled
toggle = BooleanToggle(True)  # disabled
toggle_2 = BooleanToggle(False)  # disabled
setdo_13 = SetDO(DO=addition_13, Value=toggle)  # disabled
setdo_14 = SetDO(DO=addition_13, Value=toggle_2)  # disabled

pt_7 = Point(<point referenced from the Rhino model>)
wait_at_finish = Panel("1.1")
wait = Wait(Time=wait_at_finish)
# Right Click At the Component
# Add Command Input
merge_7 = Merge(Data1=setdo_13, Data2=waitdi, Data3=setdo_14)  # disabled
panel_6 = Panel("50")
groupcmd_5 = GroupCommand(Commands=merge_7)  # disabled
speed_4 = SpeedParameter(panel_6)

# ----
# SIMULACION
simulacion = Slider(0.07581, range=0..1)

# ---- group: NOMBRE ARCHIVO
panel_7 = Panel("abb2")

# ----
# On/Off Luz Amarilla
# Iniciando/Terminando?
pin_10 = Panel("0")  # disabled
canal_real_10 = Panel("-1")  # disabled
addition_14 = Addition(A=pin_10, B=canal_real_10)  # disabled
toggle_3 = BooleanToggle(True)  # disabled
toggle_4 = BooleanToggle(False)  # disabled
setdo_15 = SetDO(DO=addition_14, Value=toggle_3)  # disabled
setdo_16 = SetDO(DO=addition_14, Value=toggle_4)  # disabled

pt_8 = Point(<point referenced from the Rhino model>)

# ----
# PRESS FOR SAVE
#        PROGRAM
button = Button()

wait_at_finish_2 = Panel("1.1")
velocidad = Panel("100")
division_13 = Division(A="100", B=velocidad)
wait_2 = Wait(Time=wait_at_finish_2)
# Right Click At the Component
# Add Command Input
merge_8 = Merge(Data1=setdo_15, Data2=waitdi_2, Data3=setdo_16)  # disabled
groupcmd_6 = GroupCommand(Commands=merge_8)  # disabled

# ----
# SIMULACION
simulacion_2 = Slider(0, range=0..1)

# ---- group: NOMBRE ARCHIVO
panel_8 = Panel("abb2")

# ----
# PRESS FOR SAVE
#        PROGRAM
button_2 = Button()

velocidad_2 = Panel("100")
division_14 = Division(A="100", B=velocidad_2)

# ----
# ORIENTACION AL CANVAS
bbox = BoundingBox(Content=flatten(pcol_2.Polyline), Plane=PlaneXY(0, 0, 0), UnionBox=True)  # -> Box, Box_2
area = Area(Geometry=bbox.Box)  # -> Area, Centroid
pl_origin = PlaneOrigin(Base=bbox.Box, Origin=area.Centroid)
area_2 = Area(Geometry=canvas)  # -> Area, Centroid
rotacion_ya_en_canvas = Slider(0, range=0..360)
yz = YZPlane(Origin=area_2.Centroid)

scale = Scale(Geometry=pcol_2.Polyline, Center=area.Centroid, Factor=number_slider_2)  # -> Geometry, Transform

orient = Orient(Geometry=scale.Geometry, Source=pl_origin, Target=canvas)  # -> Geometry, Transform
rotate_5 = Rotate(Geometry=orient.Geometry, Angle=degrees(Slider(-90, range=-90..90)), Plane=yz)  # -> Geometry, Transform

# ----
# ORIENTACION AL CANVAS
bbox_2 = BoundingBox(Content=flatten(pcol.Polyline), Plane=PlaneXY(0, 0, 0), UnionBox=True)  # -> Box, Box_2
area_3 = Area(Geometry=bbox_2.Box)  # -> Area, Centroid
pl_origin_2 = PlaneOrigin(Base=bbox_2.Box, Origin=area_3.Centroid)
area_4 = Area(Geometry=canvas)  # -> Area, Centroid
rotacion_ya_en_canvas_2 = Slider(0, range=0..360)
yz_2 = YZPlane(Origin=area_4.Centroid)

scale_2 = Scale(Geometry=pcol.Polyline, Center=area_3.Centroid, Factor=number_slider_2)  # -> Geometry, Transform

orient_2 = Orient(Geometry=scale_2.Geometry, Source=pl_origin_2, Target=canvas)  # -> Geometry, Transform
rotate_6 = Rotate(Geometry=orient_2.Geometry, Angle=degrees(Slider(-90, range=-90..90)), Plane=yz_2)  # -> Geometry, Transform

# ----
# TARGETS DEL TOOLPATH PRINCIPAL
explode = Explode(Curve=rotate_6.Geometry, Recursive=True)  # -> Segments, Vertices
xy_5 = XYPlane(Origin=explode.Vertices)
end = EndPoints(Curve=explode.Segments)  # -> Start, End
vec2pt = Vector2Pt(PointA=end.Start, PointB=end.End, Unitize=False)  # -> Vector, Length
tolerance_between_targets = Panel("5")
tufting_mm_s = Panel("20")
_0_and_1_approach_distance = Panel("-100")
wait_at_finish_3 = Panel("0.5")
list_7 = ValueList({"Joint", "Linear"}, selected="Linear")
zone = ZoneParameter(tolerance_between_targets)
speed_5 = SpeedParameter(tufting_mm_s)
panel_9 = Panel("50")
setdo_17 = SetDO(DO=dotuft, Value=Toggle(False))
setdo_18 = SetDO(DO=dotuft, Value=Toggle(True))
X_3 = UnitX(Factor=_0_and_1_approach_distance)
tolerance_at_first_and_last_point = Panel("0")
merge_9 = Merge(Data1=setdo_18, Data2=setdo)
stop_3 = StopProgram()  # disabled
merge_10 = Merge(Data1=setdo_17, Data2=setdo_2)
list_8 = ValueList({"Joint", "Linear"}, selected="Linear")
wait_3 = Wait(Time=wait_at_finish_3)
speed_6 = SpeedParameter(panel_9)
groupcmd_7 = GroupCommand(Commands=merge_9)
groupcmd_8 = GroupCommand(Commands=merge_10)
zone_2 = ZoneParameter(tolerance_at_first_and_last_point)

item = ListItem(List=vec2pt.Vector, Index="-1", Wrap=True)
ins = InsertItems(List=vec2pt.Vector, Item=item, Indices="-1", Wrap=True)

# ----
# TARGETS DEL TOOLPATH PRINCIPAL
# SALIDA
# ENTRADA
explode_2 = Explode(Curve=rotate_5.Geometry, Recursive=True)  # -> Segments, Vertices
end_2 = EndPoints(Curve=explode_2.Segments)  # -> Start, End
vec2pt_2 = Vector2Pt(PointA=end_2.Start, PointB=end_2.End, Unitize=False)  # -> Vector, Length
xy_6 = XYPlane(Origin=explode_2.Vertices)
tolerance_between_targets_2 = Panel("5")
tufting_mm_s_2 = Panel("20")
_0_and_1_approach_distance_2 = Panel("-100")
wait_at_finish_4 = Panel("0.5")
list_9 = ValueList({"Joint", "Linear"}, selected="Linear")
zone_3 = ZoneParameter(tolerance_between_targets_2)
panel_10 = Panel("50")
speed_7 = SpeedParameter(tufting_mm_s_2)
setdo_19 = SetDO(DO=dotuft_2, Value=Toggle(False))
setdo_20 = SetDO(DO=dotuft_2, Value=Toggle(True))
X_4 = UnitX(Factor=_0_and_1_approach_distance_2)
tolerance_at_first_and_last_point_2 = Panel("0")
merge_11 = Merge(Data1=setdo_20, Data2=setdo_5)
stop_4 = StopProgram()  # disabled
merge_12 = Merge(Data1=setdo_19, Data2=setdo_6)
list_10 = ValueList({"Joint", "Linear"}, selected="Linear")
wait_4 = Wait(Time=wait_at_finish_4)
speed_8 = SpeedParameter(panel_10)
groupcmd_9 = GroupCommand(Commands=merge_11)
groupcmd_10 = GroupCommand(Commands=merge_12)
zone_4 = ZoneParameter(tolerance_at_first_and_last_point_2)

item_2 = ListItem(List=vec2pt_2.Vector, Index="-1", Wrap=True)
ins_2 = InsertItems(List=vec2pt_2.Vector, Item=item_2, Indices="-1", Wrap=True)

padjust_3 = AdjustPlane(Plane=xy_6, Normal=ins_2)
pshift = ShiftPaths(Data=padjust_3, Offset="-1")
target_5 = CreateTarget(Plane=padjust_3, Motion=list_9, Tool=tool.Tool, Speed=speed_7, Zone=zone_3, IsCartesian=True)
item_3 = ListItem(List=padjust_3, Index=0, Wrap=True)
item_4 = ListItem(List=padjust_3, Index="-1", Wrap=True)
move_7 = Move(Geometry=item_3, Motion=X_4)  # -> Geometry, Transform
move_8 = Move(Geometry=item_4, Motion=X_4)  # -> Geometry, Transform
item_5 = ListItem(List=target_5, Index="0", Wrap=True)
target_6 = CreateTarget(Target=item_5, Zone=zone_4, Command=groupcmd_9, IsCartesian=True)
replace = ReplaceItems(List=target_5, Item=target_6, Indices="0", Wrap=False)
target_7 = CreateTarget(Plane=move_7.Geometry, Motion=list_10, Tool=tool.Tool, Speed=speed_8, IsCartesian=True)
lng = ListLength(List=replace)  # -> expr("x-1", Length)
item_6 = ListItem(List=replace, Index="-1", Wrap=True)
target_8 = CreateTarget(Target=target_7, Plane=move_8.Geometry, Speed=speed_3, Command=wait_4, IsCartesian=True)
target_9 = CreateTarget(Target=item_6, Zone=zone_4, Command=groupcmd_10, IsCartesian=True)
replace_2 = ReplaceItems(List=replace, Item=target_9, Indices=lng, Wrap=False)
pshift_2 = ShiftPaths(Data=replace_2, Offset="-2")
merge_13 = Merge(Data1=target_7, Data2=pshift_2, Data3=target_8)

# ----
# PUNTO PREVIO ENTRADA/SALIDA INICIO/FIN DEL TOTAL
pt_9 = Point(<point referenced from the Rhino model>)
yz_plane = YZPlane(Origin=pt_9)
list_11 = ValueList({"Joint", "Linear"}, selected="Linear")
xy_7 = XYPlane(Origin=pt_9)
target_10 = CreateTarget(Plane=xy_7, Motion=list_11, Tool=tool.Tool, Speed=speed, Zone="10", Command=wait_4, IsCartesian=True)

padjust_4 = AdjustPlane(Plane=xy_5, Normal=ins)
pshift_3 = ShiftPaths(Data=padjust_4, Offset="-1")
target_11 = CreateTarget(Plane=padjust_4, Motion=list_7, Tool=tool.Tool, Speed=speed_5, Zone=zone, IsCartesian=True)
item_7 = ListItem(List=padjust_4, Index=0, Wrap=True)
item_8 = ListItem(List=padjust_4, Index="-1", Wrap=True)
move_9 = Move(Geometry=item_7, Motion=X_3)  # -> Geometry, Transform
move_10 = Move(Geometry=item_8, Motion=X_3)  # -> Geometry, Transform
item_9 = ListItem(List=target_11, Index="0", Wrap=True)
target_12 = CreateTarget(Target=item_9, Zone=zone_2, Command=groupcmd_7, IsCartesian=True)
replace_3 = ReplaceItems(List=target_11, Item=target_12, Indices="0", Wrap=False)
lng_2 = ListLength(List=replace_3)  # -> expr("x-1", Length)
item_10 = ListItem(List=replace_3, Index="-1", Wrap=True)
target_13 = CreateTarget(Target=item_10, Zone=zone_2, Command=groupcmd_8, IsCartesian=True)
replace_4 = ReplaceItems(List=replace_3, Item=target_13, Indices=lng_2, Wrap=False)
pshift_4 = ShiftPaths(Data=replace_4, Offset="-2")

# ----
# SALIDA
# ENTRADA
target_14 = CreateTarget(Plane=move_9.Geometry, Motion=list_8, Tool=tool.Tool, Speed=speed_6, IsCartesian=True)
target_15 = CreateTarget(Target=target_14, Plane=move_10.Geometry, Speed=speed_6, Command=wait_3, IsCartesian=True)

merge_14 = Merge(Data1=target_14, Data2=pshift_4, Data3=target_15)

flatten_5 = FlattenTree(Tree=merge_14, Path="{0}")
merge_15 = Merge(Data1=target_10, Data2=flatten(merge_13), Data3=target_2, Data4=flatten(flatten_5), Data5=target_10)

# ----
# TOOLPATH GENERAL
merge_16 = Merge(Data1=merge_13, Data2=target_2, Data3=flatten_5)

# ----
# POSICION INICIAL/FINAL
merge_17 = Merge(Data1=target, Data2=merge_15, Data3=target)

create_program = CreateProgram(Name=panel_7, RobotSystem=load_robot, Targets=flatten(merge_17), StepSize=1)  # -> Program, Code, Duration, Warnings, Errors

gate = StreamGate(Stream=create_program.Program, Gate=button)  # -> Target0, Target1

# ---- group: Simulation
sim = ProgramSimulation(Program=create_program.Program, Time=simulacion, Normalized=True)  # -> SystemMeshes, JointRotations, Plane, Index, Time, Program, Errors
lng_3 = ListLength(List=sim.SystemMeshes)
trail = SimpleTrail(Program=sim.Program, Length="100000", MechanicalGroup=0)
subtraction = Subtraction(A=lng_3, B=1)
split = SplitList(List=sim.SystemMeshes, Index=subtraction)  # -> ListA, ListB
frgb = ColourRGBF(Alpha=1, Red="0.965", Green="0.471", Blue="0.157")
item_11 = ListItem(List=split.ListA, Index="-1", Wrap=True)
frgb_2 = ColourRGBF(Alpha=1, Red="0.5195", Green="0.5312", Blue="0.5391")
material = CreateMaterial(Diffuse=frgb, Specular=RGB(255, 255, 255), Emission=RGB(0, 0, 0), Transparency=0, Shine=0)
cull_i_3 = CullIndex(List=split.ListA, Indices="-1", Wrap=True)
material_2 = CreateMaterial(Diffuse=frgb_2, Specular=RGB(255, 255, 255), Emission=RGB(0, 0, 0), Transparency=0, Shine=0)
material_3 = CreateMaterial(
    Diffuse=ColourSwatch(SwatchColor=RGB(209, 79, 79)),
    Specular=RGB(255, 255, 255),
    Emission=ColourSwatch(SwatchColor=RGB(46, 18, 18)),
    Transparency=0,
    Shine=0)

# ----
panel_11 = Panel(sim.Index)
multiplication_5 = Multiplication(A=sim.Time, B=division_13)
panel_12 = Panel(create_program.Errors)
panel_13 = Panel(create_program.Warnings)
cluster = Cluster(t=sim.Time)
cluster_2 = Cluster(t=multiplication_5)
division_15 = Division(A=create_program.Duration, B="3600")
saveprog = SaveProgram(Program=gate.Target1, Folder="D:\ROBOT_PROG\1200_TUFTING\EUPROJ\ABB")
duracion = Panel(cluster)
duracion_2 = Panel(cluster_2)
duracion_horas = Panel(division_15)

# ----
# ROBOT SIMULACION
preview = CustomPreview(Geometry=cull_i_3, Material=material)
preview_2 = CustomPreview(Geometry=item_11, Material=material_2)
preview_3 = CustomPreview(Geometry=split.ListB, Material=material_3)

panel_14 = Panel(create_program.Code)

# ----
# ORIENTACION AL CANVAS
bbox_3 = BoundingBox(Content=flatten(pcol_4.Polyline), Plane=PlaneXY(0, 0, 0), UnionBox=True)  # -> Box, Box_2
area_5 = Area(Geometry=bbox_3.Box)  # -> Area, Centroid
pl_origin_3 = PlaneOrigin(Base=bbox_3.Box, Origin=area_5.Centroid)
rotacion_ya_en_canvas_3 = Slider(0, range=0..360)

scale_3 = Scale(Geometry=pcol_4.Polyline, Center=area_5.Centroid, Factor=number_slider_6)  # -> Geometry, Transform

orient_3 = Orient(Geometry=scale_3.Geometry, Source=pl_origin_3, Target=canvas_2)  # -> Geometry, Transform
rotate_7 = Rotate(Geometry=orient_3.Geometry, Angle=degrees(Slider(-90, range=-90..90)), Plane=pflip)  # -> Geometry, Transform

l_branch_3 = ListBranch(T=rotate_7.Geometry, i=series)
l_branch_4 = ListBranch(T=rotate_7.Geometry, i=series_2)

# ----
# ORIENTACION AL CANVAS
bbox_4 = BoundingBox(Content=flatten(pcol_4.Polyline), Plane=PlaneXY(0, 0, 0), UnionBox=True)  # -> Box, Box_2
area_6 = Area(Geometry=bbox_4.Box)  # -> Area, Centroid
pl_origin_4 = PlaneOrigin(Base=bbox_4.Box, Origin=area_6.Centroid)
area_7 = Area(Geometry=canvas_3)  # -> Area, Centroid
rotacion_ya_en_canvas_4 = Slider(0, range=0..360)
yz_3 = YZPlane(Origin=area_7.Centroid)

scale_4 = Scale(Geometry=pcol_4.Polyline, Center=area_6.Centroid, Factor=number_slider_6)  # -> Geometry, Transform

orient_4 = Orient(Geometry=scale_4.Geometry, Source=pl_origin_4, Target=canvas_3)  # -> Geometry, Transform
rotate_8 = Rotate(Geometry=orient_4.Geometry, Angle=degrees(Slider(-90, range=-90..90)), Plane=pflip_2)  # -> Geometry, Transform

l_branch_5 = ListBranch(T=rotate_8.Geometry, i=series_3)
l_branch_6 = ListBranch(T=rotate_8.Geometry, i=series_4)
stack_3 = StackTrees(Data0=l_branch_3, Data1=l_branch_5, Reduce=True)
stack_4 = StackTrees(Data0=l_branch_4, Data1=l_branch_6, Reduce=True)
previewlw = CustomPreviewLineweights(Geometry=stack_3, Shader=shader, Thickness=Slider(2, range=1..5), Absolute=False)
previewlw_2 = CustomPreviewLineweights(Geometry=stack_4, Shader=shader_2, Thickness=Slider(2, range=1..5), Absolute=False)

# ----
# TARGETS DEL TOOLPATH PRINCIPAL
explode_3 = Explode(Curve=stack_4, Recursive=True)  # -> Segments, Vertices
xy_8 = XYPlane(Origin=explode_3.Vertices)
end_3 = EndPoints(Curve=explode_3.Segments)  # -> Start, End
vec2pt_3 = Vector2Pt(PointA=end_3.Start, PointB=end_3.End, Unitize=False)  # -> Vector, Length
tolerance_between_targets_3 = Panel("5")
tufting_mm_s_3 = Panel("20")
_0_and_1_approach_distance_3 = Panel("-100")
wait_at_finish_5 = Panel("0.5")
list_12 = ValueList({"Joint", "Linear"}, selected="Linear")
zone_5 = ZoneParameter(tolerance_between_targets_3)
speed_9 = SpeedParameter(tufting_mm_s_3)
panel_15 = Panel("50")
setdo_21 = SetDO(DO=dotuft_3, Value=Toggle(False))
setdo_22 = SetDO(DO=dotuft_3, Value=Toggle(True))
X_5 = UnitX(Factor=_0_and_1_approach_distance_3)
tolerance_at_first_and_last_point_3 = Panel("0")
merge_18 = Merge(Data1=setdo_22, Data2=setdo_7)
stop_5 = StopProgram()  # disabled
merge_19 = Merge(Data1=setdo_21, Data2=setdo_8)
list_13 = ValueList({"Joint", "Linear"}, selected="Linear")
wait_5 = Wait(Time=wait_at_finish_5)
speed_10 = SpeedParameter(panel_15)
groupcmd_11 = GroupCommand(Commands=merge_18)
groupcmd_12 = GroupCommand(Commands=merge_19)
zone_6 = ZoneParameter(tolerance_at_first_and_last_point_3)

item_12 = ListItem(List=vec2pt_3.Vector, Index="-1", Wrap=True)
ins_3 = InsertItems(List=vec2pt_3.Vector, Item=item_12, Indices="-1", Wrap=True)

# ----
# TARGETS DEL TOOLPATH PRINCIPAL
# SALIDA
# ENTRADA
explode_4 = Explode(Curve=stack_3, Recursive=True)  # -> Segments, Vertices
end_4 = EndPoints(Curve=explode_4.Segments)  # -> Start, End
vec2pt_4 = Vector2Pt(PointA=end_4.Start, PointB=end_4.End, Unitize=False)  # -> Vector, Length
xy_9 = XYPlane(Origin=explode_4.Vertices)
tolerance_between_targets_4 = Panel("5")
tufting_mm_s_4 = Panel("20")
_0_and_1_approach_distance_4 = Panel("-100")
wait_at_finish_6 = Panel("0.5")
list_14 = ValueList({"Joint", "Linear"}, selected="Linear")
zone_7 = ZoneParameter(tolerance_between_targets_4)
panel_16 = Panel("50")
speed_11 = SpeedParameter(tufting_mm_s_4)
setdo_23 = SetDO(DO=dotuft_4, Value=Toggle(False))
setdo_24 = SetDO(DO=dotuft_4, Value=Toggle(True))
X_6 = UnitX(Factor=_0_and_1_approach_distance_4)
tolerance_at_first_and_last_point_4 = Panel("0")
merge_20 = Merge(Data1=setdo_24, Data2=setdo_11)
stop_6 = StopProgram()  # disabled
merge_21 = Merge(Data1=setdo_23, Data2=setdo_12)
list_15 = ValueList({"Joint", "Linear"}, selected="Linear")
wait_6 = Wait(Time=wait_at_finish_6)
speed_12 = SpeedParameter(panel_16)
groupcmd_13 = GroupCommand(Commands=merge_20)
groupcmd_14 = GroupCommand(Commands=merge_21)
zone_8 = ZoneParameter(tolerance_at_first_and_last_point_4)

item_13 = ListItem(List=vec2pt_4.Vector, Index="-1", Wrap=True)
ins_4 = InsertItems(List=vec2pt_4.Vector, Item=item_13, Indices="-1", Wrap=True)

padjust_5 = AdjustPlane(Plane=xy_9, Normal=ins_4)
pshift_5 = ShiftPaths(Data=padjust_5, Offset="-1")
target_16 = CreateTarget(Plane=padjust_5, Motion=list_14, Tool=tool_2.Tool, Speed=speed_11, Zone=zone_7, IsCartesian=True)
item_14 = ListItem(List=padjust_5, Index=0, Wrap=True)
item_15 = ListItem(List=padjust_5, Index="-1", Wrap=True)
move_11 = Move(Geometry=item_14, Motion=X_6)  # -> Geometry, Transform
move_12 = Move(Geometry=item_15, Motion=X_6)  # -> Geometry, Transform
item_16 = ListItem(List=target_16, Index="0", Wrap=True)
target_17 = CreateTarget(Target=item_16, Zone=zone_8, Command=groupcmd_13, IsCartesian=True)
replace_5 = ReplaceItems(List=target_16, Item=target_17, Indices="0", Wrap=False)
target_18 = CreateTarget(Plane=move_11.Geometry, Motion=list_15, Tool=tool_2.Tool, Speed=speed_12, IsCartesian=True)
lng_4 = ListLength(List=replace_5)  # -> expr("x-1", Length)
item_17 = ListItem(List=replace_5, Index="-1", Wrap=True)
target_19 = CreateTarget(Target=target_18, Plane=move_12.Geometry, Speed=speed_4, Command=wait_6, IsCartesian=True)
target_20 = CreateTarget(Target=item_17, Zone=zone_8, Command=groupcmd_14, IsCartesian=True)
replace_6 = ReplaceItems(List=replace_5, Item=target_20, Indices=lng_4, Wrap=False)
pshift_6 = ShiftPaths(Data=replace_6, Offset="-2")
merge_22 = Merge(Data1=target_18, Data2=pshift_6, Data3=target_19)

# ----
# PUNTO PREVIO ENTRADA/SALIDA INICIO/FIN DEL TOTAL
pt_10 = Point(<point referenced from the Rhino model>)
yz_plane_2 = YZPlane(Origin=pt_10)
list_16 = ValueList({"Joint", "Linear"}, selected="Linear")
xy_10 = XYPlane(Origin=pt_10)
target_21 = CreateTarget(Plane=xy_10, Motion=list_16, Tool=tool_2.Tool, Speed=speed_2, Zone="10", Command=wait_6, IsCartesian=True)

padjust_6 = AdjustPlane(Plane=xy_8, Normal=ins_3)
pshift_7 = ShiftPaths(Data=padjust_6, Offset="-1")
target_22 = CreateTarget(Plane=padjust_6, Motion=list_12, Tool=tool_2.Tool, Speed=speed_9, Zone=zone_5, IsCartesian=True)
item_18 = ListItem(List=padjust_6, Index=0, Wrap=True)
item_19 = ListItem(List=padjust_6, Index="-1", Wrap=True)
move_13 = Move(Geometry=item_18, Motion=X_5)  # -> Geometry, Transform
move_14 = Move(Geometry=item_19, Motion=X_5)  # -> Geometry, Transform
item_20 = ListItem(List=target_22, Index="0", Wrap=True)
target_23 = CreateTarget(Target=item_20, Zone=zone_6, Command=groupcmd_11, IsCartesian=True)
replace_7 = ReplaceItems(List=target_22, Item=target_23, Indices="0", Wrap=False)
lng_5 = ListLength(List=replace_7)  # -> expr("x-1", Length)
item_21 = ListItem(List=replace_7, Index="-1", Wrap=True)
target_24 = CreateTarget(Target=item_21, Zone=zone_6, Command=groupcmd_12, IsCartesian=True)
replace_8 = ReplaceItems(List=replace_7, Item=target_24, Indices=lng_5, Wrap=False)
pshift_8 = ShiftPaths(Data=replace_8, Offset="-2")

# ----
# SALIDA
# ENTRADA
target_25 = CreateTarget(Plane=move_13.Geometry, Motion=list_13, Tool=tool_2.Tool, Speed=speed_10, IsCartesian=True)
target_26 = CreateTarget(Target=target_25, Plane=move_14.Geometry, Speed=speed_10, Command=wait_5, IsCartesian=True)

merge_23 = Merge(Data1=target_25, Data2=pshift_8, Data3=target_26)

flatten_6 = FlattenTree(Tree=merge_23, Path="{0}")
merge_24 = Merge(Data1=target_21, Data2=flatten(merge_22), Data3=target_4, Data4=flatten(flatten_6), Data5=target_21)

# ----
# TOOLPATH GENERAL
merge_25 = Merge(Data1=merge_22, Data2=target_4, Data3=flatten_6)

# ----
# POSICION INICIAL/FINAL
merge_26 = Merge(Data1=target_3, Data2=merge_24, Data3=target_3)

create_program_2 = CreateProgram(Name=panel_8, RobotSystem=load_robot_2, Targets=flatten(merge_26), StepSize=1)  # -> Program, Code, Duration, Warnings, Errors

gate_2 = StreamGate(Stream=create_program_2.Program, Gate=button_2)  # -> Target0, Target1

# ---- group: Simulation
sim_2 = ProgramSimulation(Program=create_program_2.Program, Time=simulacion_2, Normalized=True)  # -> SystemMeshes, JointRotations, Plane, Index, Time, Program, Errors
lng_6 = ListLength(List=sim_2.SystemMeshes)
trail_2 = SimpleTrail(Program=sim_2.Program, Length="100000", MechanicalGroup=0)
subtraction_2 = Subtraction(A=lng_6, B=1)
split_2 = SplitList(List=sim_2.SystemMeshes, Index=subtraction_2)  # -> ListA, ListB
frgb_3 = ColourRGBF(Alpha=1, Red="0.965", Green="0.471", Blue="0.157")
item_22 = ListItem(List=split_2.ListA, Index="-1", Wrap=True)
frgb_4 = ColourRGBF(Alpha=1, Red="0.5195", Green="0.5312", Blue="0.5391")
material_4 = CreateMaterial(Diffuse=frgb_3, Specular=RGB(255, 255, 255), Emission=RGB(0, 0, 0), Transparency=0, Shine=0)
cull_i_4 = CullIndex(List=split_2.ListA, Indices="-1", Wrap=True)
material_5 = CreateMaterial(Diffuse=frgb_4, Specular=RGB(255, 255, 255), Emission=RGB(0, 0, 0), Transparency=0, Shine=0)
material_6 = CreateMaterial(
    Diffuse=ColourSwatch(SwatchColor=RGB(209, 79, 79)),
    Specular=RGB(255, 255, 255),
    Emission=ColourSwatch(SwatchColor=RGB(46, 18, 18)),
    Transparency=0,
    Shine=0)

# ----
panel_17 = Panel(sim_2.Index)
multiplication_6 = Multiplication(A=sim_2.Time, B=division_14)
panel_18 = Panel(create_program_2.Errors)
panel_19 = Panel(create_program_2.Warnings)
cluster_3 = Cluster(t=sim_2.Time)
cluster_4 = Cluster(t=multiplication_6)
division_16 = Division(A=create_program_2.Duration, B="3600")
saveprog_2 = SaveProgram(Program=gate_2.Target1, Folder="D:\ROBOT_PROG\1200_TUFTING\EUPROJ\ABB")
duracion_3 = Panel(cluster_3)
duracion_4 = Panel(cluster_4)
duracion_horas_2 = Panel(division_16)

# ----
# ROBOT SIMULACION
preview_4 = CustomPreview(Geometry=cull_i_4, Material=material_4)
preview_5 = CustomPreview(Geometry=item_22, Material=material_5)
preview_6 = CustomPreview(Geometry=split_2.ListB, Material=material_6)

panel_20 = Panel(create_program_2.Code)

# ==== cluster Cluster
t = ClusterInput()  # Time (seconds)
integer_division = IntegerDivision(A=t, B="60")
integer_division_2 = IntegerDivision(A=integer_division, B="60")
multiplication = Multiplication(A=integer_division, B="60")
multiplication_2 = Multiplication(A=integer_division_2, B="60")
subtraction = Subtraction(A=t, B=multiplication)
subtraction_2 = Subtraction(A=integer_division, B=multiplication_2)
integer_division_3 = IntegerDivision(A=subtraction, B="1")
concat = Concatenate(FragmentA=subtraction_2, FragmentB=" min ")
concat_2 = Concatenate(FragmentA=integer_division_2, FragmentB="h ")
concat_3 = Concatenate(FragmentA=integer_division_3, FragmentB=" seg")
concat_4 = Concatenate(FragmentC=concat_2, FragmentA=concat, FragmentB=concat_3)
duration = ClusterOutput(concat_4)

# ==== cluster CullBranch
T = ClusterInput()
I = ClusterInput()
T_2 = Data(T)
tstat = TreeStatistics(Tree=T_2)  # -> Paths, Length, Count
cull_i = CullIndex(List=tstat.Paths, Indices=I, Wrap=True)
branch = TreeBranch(Tree=T_2, Path=cull_i, MaintainPaths=True)
B = ClusterOutput(branch)

# ==== cluster ListBranch: Select a specific branch from tree
T = ClusterInput()
i = ClusterInput()
T_2 = Data(T)
tstat = TreeStatistics(Tree=T_2)  # -> Paths, Length, Count
item = ListItem(List=tstat.Paths, Index=i, Wrap=True)
branch = TreeBranch(Tree=T_2, Path=item, MaintainPaths=True)
B = ClusterOutput(branch)
